# Grasshopper definition Chovghi - CEM Structure.ghx (Grasshopper 1.0.7)
# Copyright: Felswind
# plug-ins: CEM_Build_Topology, CEM_Deviation, CEM_Extract_Topology, CEM_Support, CEM_Trail, CEM_Calculate_Structure, CEM_Extract_Structure, CEM_Origin_Node, CEM_Load

r_m = Slider(3.4, range=0.1..100)
l_int = Slider(15, range=2..100)
res_int = Slider(10, range=3..100)

# ----
# 00 - Input
tp = GhPythonScript(r=r_m, l=l_int, res=res_int)  # -> T, N, Dt, D, S; inputs r: Int32, l: Int32, res: Int32
# ---------- tp: Python ----------
"""Creates a CEM Topology.
    Inputs:
        r: Base radius [m]
        l: Number of layer [int]
        res: Resolution [int]
    Output:
        T: Trail elements
        N: Nodes of the strucutre
        Dt: First Ring of Deviation Elements
        D: Deviation Elements
        S: Support Nodes"""

__author__ = "Frederic Chovghi"

import ghpythonlib.components as gh



###########################################################
## Create CEM Topology
###########################################################

T = []
N = []
Dt = []
D = []
S = []

bp = gh.XYPlane(gh.ConstructPoint(0,0,0)) #Base  plane

for i in range(l):
    
    circle = gh.Circle(bp, r+(i*0.5))
    cp = gh.DivideCurve(circle, res, False)[0]
    N.extend(cp)
    
    pl = gh.PolyLine(cp, True)
    pl = gh.Explode(pl, True)[0]
    
    if i != 0:
        tl = [gh.Line(cp[x], cpp[x]) for x in range(len(cp))]
        T.extend(tl)
    
    cpp = cp[:]
    
    #Export Elements
    if i == 0: Dt.extend(pl)
    if i != 0: D.extend(pl)
    
    if i ==l-1: S.extend(cp)
# ---------- end tp ----------

# ----
# 01 - CEM Model
number_slider = Slider(0.5, range=-100..100)
cem_deviation = CEM_Deviation(DeviationEdge=tp.Dt, DeviationMagn=Slider(0.5, range=-100..100))
cem_deviation_2 = CEM_Deviation(DeviationEdge=tp.D, DeviationMagn=number_slider)
cem_load = CEM_Load(PointLoad=tp.N, LoadMagnZ=Slider(-1, range=-100..100))
cem_trail = CEM_Trail(TrailEdge=tp.T, TrailLen=Slider(-0.5, range=-100..100))
cem_support = CEM_Support(Support=tp.S)
cem_build_topology = CEM_Build_Topology(T=flatten(cem_trail), L=cem_load, D=flatten([cem_deviation, cem_deviation_2]), S=flatten(cem_support))
cem_extract_topology = CEM_Extract_Topology(TP=cem_build_topology)  # -> Nodes, NodesID, Edges, EdgesID, ConstraintPlane, ConstraintPlaneID, OriginNode, OriginNodeID
cem_origin_node = CEM_Origin_Node(OriginNode=cem_extract_topology.OriginNode, OriginNodeID=cem_extract_topology.OriginNodeID)
cem_calculate_structure = CEM_Calculate_Structure(TP=cem_build_topology, N=cem_origin_node)
cem_extract_structure = CEM_Extract_Structure(M=cem_calculate_structure)  # -> Nodes, NodesID, Trails, TrailsID, TrailsCol, TrailsMag, Deviations, DeviationsID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
end_points = EndPoints(Curve=cem_extract_structure.ExternalForces)  # -> Start, End
scale = Scale(Geometry=cem_extract_structure.ExternalForces, Center=end_points.Start, Factor=0.25)  # -> Geometry, Transform
custom_preview = CustomPreview(
    Geometry=[cem_extract_structure.Trails, cem_extract_structure.Deviations],
    Material=[cem_extract_structure.TrailsCol, cem_extract_structure.DeviationsCol])
custom_preview_2 = CustomPreview(Geometry=scale.Geometry, Material=cem_extract_structure.ExternalForcesCol)

# ----
# 02 - Mesh model
join_curves = JoinCurves(Curves=cem_extract_structure.Deviations, Preserve=False)
construct_point = ConstructPoint(XCoordinate=100, YCoordinate=0, ZCoordinate=0)
curve_closest_point = CurveClosestPoint(Point=construct_point, Curve=join_curves)  # -> Point, Parameter, Distance
deconstruct = Deconstruct(Point=curve_closest_point.Point)  # -> XComponent, YComponent, ZComponent
seam = Seam(Curve=flatten(join_curves), Seam=flatten(curve_closest_point.Parameter))
sort_list = SortList(Keys=deconstruct.ZComponent, ValuesValuesA=seam)  # -> Keys, ValuesValuesA
mesh = GhPythonScript(C=sort_list.ValuesValuesA)  # -> M; inputs C: list of Curve
# ---------- mesh: Python ----------
import ghpythonlib.components as gh

M = []

for i in range(len(C)-1):
    
    cp_a = gh.ControlPoints(C[i])[0]
    cp_b = gh.ControlPoints(C[i+1])[0]
    
    for k in range(len(cp_a)-1):
        
        mloc = gh.ConstructMesh([cp_a[k], cp_a[k+1], cp_b[k+1], cp_b[k]], 'Q{0;1;2;3}')
        M.append(mloc)

M = gh.MeshJoin(M)
# ---------- end mesh ----------
custom_preview_3 = CustomPreview(Geometry=mesh, Material=ColourSwatch(SwatchColor=RGBA(76, 76, 76, 44)))
