# Grasshopper definition ex5_mobile_robot_moveit_simulation_robotAA.ghx (Grasshopper 1.0.7)
# plug-ins: LunchBox

# ----
# Color Coding
colour_swatch = ColourSwatch(SwatchColor=RGB(0, 0, 255))
color_coding = GhPythonScript(
    is_planned=ColourSwatch(SwatchColor=RGB(255, 192, 0)),
    is_built=ColourSwatch(SwatchColor=RGB(207, 255, 181)),
    is_support=colour_swatch,
    has_open_connector=ColourSwatch(SwatchColor=RGB(126, 255, 61)),
    has_no_open_connectors=ColourSwatch(SwatchColor=RGB(200, 200, 200)),
    is_built_by_robot=ColourSwatch(SwatchColor=RGB(175, 224, 220)),
    is_built_by_human=ColourSwatch(SwatchColor=RGB(242, 229, 0)))  # -> out, color_coding
# ---------- color_coding: Python ----------
import rhinoscriptsyntax as rs
from compas.colors import Color


color_is_planned = Color(is_planned.R/255 , is_planned.G/255, is_planned.B/255)
color_is_built = Color(is_built.R/255 , is_built.G/255, is_built.B/255)
color_is_support = Color(is_support.R/255 , is_support.G/255, is_support.B/255)
color_has_open_connector = Color(has_open_connector.R/255 , has_open_connector.G/255,has_open_connector.B/255)
color_has_no_open_connectors = Color(has_no_open_connectors.R/255 , has_no_open_connectors.G/255, has_no_open_connectors.B/255)
color_is_built_by_robot = Color(is_built_by_robot.R/255 , is_built_by_robot.G/255, is_built_by_robot.B/255)
color_is_built_by_human = Color(is_built_by_human.R/255 , is_built_by_human.G/255, is_built_by_human.B/255)

color_coding = {'color_is_planned':color_is_planned, 'color_is_built':color_is_built, 'color_is_support':color_is_support, 'color_has_open_connector':color_has_open_connector, 'color_has_no_open_connectors':color_has_no_open_connectors, 'color_is_built_by_robot':color_is_built_by_robot, 'color_is_built_by_human':color_is_built_by_human}

print color_coding
# ---------- end color_coding ----------
panel = Panel(color_coding.out)

panel_2 = Panel("trunk_liuba_24072023_assembly.json")
panel_3 = Panel("assembly_example_02_230726.json")
panel_4 = Panel("2023_07_25_17_12_Middle_80cm_Rebuild_Precise_assembly.json")

# ----
# Load robot locally
# Load robot from local package
py = PythonScript()  # -> mobile_robot_data_path, ur_data_path
# ---------- py: Python ----------
import os

"""
ASSUMING THE BELOW PACKAGES ARE STORED IN THE SAME LOCATION:
    ur_fabrication_control;
    rbvogui_common; and
    mobile_additive_manufacturing.
"""

repositories_path = os.path.abspath(os.path.join(ghdoc.Path,"../../../"))

assert os.path.exists(os.path.join(repositories_path, "ur_fabrication_control/data"))
assert os.path.exists(os.path.join(repositories_path, "mobile_robot_control/data/rbvogui_xl_lift_ur10e_description"))

ur_data_path = os.path.abspath(os.path.join(ghdoc.Path,"../../../ur_fabrication_control/data"))
mobile_robot_data_path = os.path.abspath(os.path.join(ghdoc.Path,"../../../mobile_robot_control/data"))
# ---------- end py ----------
list = ValueList({"indoor", "outdoor"}, selected="indoor")
py_2 = PythonScript(mobile_robot_data_path=py.mobile_robot_data_path, ur_data_path=py.ur_data_path, wheel_type=list)  # -> loaders, urdf_filename, srdf_filename
# ---------- py_2: Python ----------
import os
from compas.robots import LocalPackageMeshLoader

#loaders

ur_path = os.path.join(ur_data_path, "robot_description")
ur_packages = ["ur_description", "ur_e_description", "ur_end_effectors", "ur_setups"]
ur_loaders = [LocalPackageMeshLoader(ur_path, pck) for pck in ur_packages]

mobile_robot_path = os.path.join(mobile_robot_data_path, "rbvogui_xl_lift_ur10e_description")
rbvogui_packages = ["rbvogui_description"]
rbvogui_loaders = [LocalPackageMeshLoader(mobile_robot_path, pck) for pck in rbvogui_packages]

ewellix_packages = ["ewellix_description"]
ewellix_loaders = [LocalPackageMeshLoader(mobile_robot_path, pck) for pck in ewellix_packages]

sensors_packages = ["robotnik_sensors"]
sensors_loaders = [LocalPackageMeshLoader(mobile_robot_path, pck) for pck in sensors_packages]

loaders = ur_loaders + rbvogui_loaders + ewellix_loaders + sensors_loaders

#files
if wheel_type=="indoor":
    urdf_filename = os.path.join(mobile_robot_data_path, r"rbvogui_xl_lift_ur10e_indoor.urdf")
if wheel_type == "outdoor":
    urdf_filename = os.path.join(mobile_robot_data_path, r"rbvogui_xl_lift_ur10e.urdf")
srdf_filename = os.path.join(mobile_robot_data_path, r"rbvogui.srdf")

assert os.path.isfile(urdf_filename)
assert os.path.isfile(srdf_filename)
# ---------- end py_2 ----------
load = Button()
units = ValueList({"m": 1, "cm": 100, "mm": 1000}, selected="m")
create = PythonScript(
    load=load,
    loaders=py_2.loaders,
    urdf_filename=py_2.urdf_filename,
    srdf_filename=py_2.srdf_filename,
    scale_factor=units,
    wheel_type=list)  # -> out, robot; inputs load: Boolean, loaders: list
# ---------- create: Python ----------
import os
from scriptcontext import sticky as st

import compas

from compas_ghpython import draw_frame
from compas.robots import RobotModel
from compas.robots import LocalPackageMeshLoader

from mobile_robot_control.mobile_robot import MobileRobot
from compas_fab.robots import RobotSemantics
from compas_fab.ghpython import RobotArtist

compas.PRECISION = '12f'

# store robot in component
guid = str(ghenv.Component.InstanceGuid)
robot_key = "robot"

if robot_key not in st:
    st[robot_key] = None

#print loaders
if load:
    model = RobotModel.from_urdf_file(urdf_filename)
    model.load_geometry(*loaders)
    artist = RobotArtist(model)
    semantics = RobotSemantics.from_srdf_file(srdf_filename, model)
    robot = MobileRobot(model, artist, semantics, client=None, wheel_type=wheel_type)
    
    st[robot_key] = robot

robot = st[robot_key]
robot.wheel_type = wheel_type
print(robot)

rcf = draw_frame(robot.get_RCF())
print(rcf)
# ---------- end create ----------

py_3 = PythonScript()  # -> ENVIRONMENT_NAME, HERE, DATA
# ---------- py_3: Python ----------
import os
import compas_bootstrapper

HERE = os.path.dirname(ghdoc.Path)
DATA = os.path.abspath(os.path.join(HERE, "..", "data"))
ENVIRONMENT_NAME = compas_bootstrapper.ENVIRONMENT_NAME
print(HERE)
print(DATA)
print(ENVIRONMENT_NAME)
# ---------- end py_3 ----------

panel_5 = Panel("Unload libraries")
bang = Button()
unload = PythonScript(bang=bang)
# ---------- unload: Python ----------
from compas_rhino.utilities.misc import get_tolerance
from compas_rhino.utilities.misc import unload_modules

unload_modules("cdf_2023")
unload_modules("robot_mobile_control")
unload_modules("ur_fabrication_control")
# ---------- end unload ----------

# ----
# Marker Tracking
toggle = BooleanToggle(False)
init = Button()
fabricationmanager = GhPythonScript(init=init, parallelize=toggle)  # -> fabrication
# ---------- fabricationmanager: Python ----------
from scriptcontext import sticky as st
from fabrication_manager.fabrication import FabricationManager


server_ip = st["server_ip"]
server_port = st["server_port"]

if init:
    fabrication = FabricationManager((server_ip, server_port))
    fabrication.parallelize = parallelize
    st["fabrication"] = fabrication

fabrication = st["fabrication"]
# ---------- end fabricationmanager ----------
create_tasks = Button()
tasks = GhPythonScript(create=create_tasks, fabrication=fabricationmanager)  # -> tasks
# ---------- tasks: Python ----------
import time
from scriptcontext import sticky as st
from fabrication_manager.task import Task
from ur_fabrication_control.direct_control.fabrication_process import URTask
from mobile_robot_control import MoveJointsTask, MotionPlanTask, SearchAndSaveMarkersTask, GetMarkerPoseTask, FixRobotToMarkerTask, MoveLinearTask
from compas.geometry import Box, Frame, Translation, Vector, Transformation
from compas.datastructures import Mesh
from compas_rhino.conversions import RhinoPlane
from compas_fab.robots import Configuration

ur_ip = st['ur_ip']
ur_port = st['ur_port']
robot_address = (ur_ip, ur_port)


configuration = robot.zero_configuration()
print(robot.get_link_names('ur10e_and_liftkit'))
frame = robot.forward_kinematics(configuration, 'ur10e_and_liftkit', True, options={'link':'robot_ewellix_lift_top_link'})
print(frame)
robot.get_base_link_name()

def get_BCF_in_MCF(marker_id):
    MCF_in_WCF = robot.mobile_client.marker_frames[marker_id]
    WCF_in_MCF = Frame.from_transformation(Transformation.from_frame(MCF_in_WCF).inverted()) # BCF in measured MCF
    return WCF_in_MCF

#x = get_BCF_in_MCF('marker_0')
#print(x)

if create:
#    frame = robot.mobile_client.marker_frames['marker_12'].transformed(Translation.from_vector(Vector.Zaxis() * 0.50))
#    tasks = [MoveLinearTask(robot, robot_address, frame, in_RCF=True, velocity=0.10, radius=0.0, payload=1.500, key=0)]
    tasks = [SearchAndSaveMarkersTask(robot, robot_address, fabrication, duration=10, initial_search=True, update=True, key=0)]
#    tasks = [FixRobotToMarkerTask(robot, fixed_marker_id="marker_0", key=0)]
    st['tasks'] = tasks
    print(st['tasks'])

tasks = st['tasks']
# ---------- end tasks ----------
draw_planes = GhPythonScript(fabrication=fabricationmanager)  # -> out, planes
# ---------- draw_planes: Python ----------
from compas_fab.robots import Configuration
from compas_ghpython import draw_frame


task = fabrication.get_task_by_key(0)

planes = task.results.get("planes")
# ---------- end draw_planes ----------
start_fabrication = Button()
stop_fabrication = Button()
pline = PolyLine(Vertices=draw_planes.planes, Closed=False)
next_task = Button()
reset_task = Button()
prev_task = Button()
set_tasks = Button()
reset = Button()
preview = CustomPreview(Geometry=pline, Material=ColourSwatch(SwatchColor=RGB(59, 137, 161)))
fabricationmanager_2 = PythonScript(
    tasks=tasks,
    fabrication=fabricationmanager,
    set_tasks=set_tasks,
    start=start_fabrication,
    stop=stop_fabrication,
    reset=reset,
    next_task=next_task,
    reset_task=reset_task,
    prev_task=prev_task)  # -> out, server; inputs tasks: list
# ---------- fabricationmanager_2: Python ----------
if set_tasks:
    print "setting tasks"    
    fabrication.clear_tasks()
    fabrication.set_tasks(tasks)

if start:
    #if robot.is_connected(): #and arduino.is_connected():
    print "starting process"
    fabrication.start()

if stop:
    print "stopping process"
    fabrication.stop()
    
if reset:
    print "resetting process"
    fabrication.reset()

if next_task:
    t = fabrication.get_next_task()
    task_state_set(True, t)
    
if reset_task:
    t = fabrication.get_next_task()
    task_state_set(False, t)

if prev_task:
    t = fabrication.get_next_task()
    task_state_set(False, t)
    t = fabrication.tasks[fabrication.current_task_key-1]
    task_state_set(False, t)
    fabrication.get_next_task()

def task_state_set(state, t):
    t.is_completed = state
    t.is_running = False
# ---------- end fabricationmanager_2 ----------

# ---- group: cartesian motion
# Save assembly to json
panel_6 = Panel("assembly_stack_planned.json")  # disabled
save = Button()  # disabled
python = PythonScript(name=panel_6, save=save)  # -> out, a; disabled
# ---------- python: Python ----------
import os
filename = os.path.join(DATA, name)

print assembly.element(0)

if save:
    assembly.to_json(filename, pretty=True)
# ---------- end python ----------

# ----
# Get the 'current key' from Realtime Database
panel_7 = Panel("C:\Users\lidet\workspace\projects\cdf_2023")
connect = BooleanToggle(False)
get = Button()
data = Data(panel_7)
read = GhPythonScript(path=data, connect=connect, get_current_key=get)  # -> out, current_index; inputs connect: Boolean, get_current_key: Boolean
# ---------- read: Python ----------
import os
from scriptcontext import sticky
import Grasshopper as gh
from compas.rpc import Proxy
import scriptcontext as rs

if "current_stick" not in sticky:
    sticky["current_stick"] = 0


if connect:
    p = Proxy(package = 'cdf_2023.firebase.realtime_database', path=path +'\src')
    
    p.stop_server()
    p.start_server()
    if get_current_key:
        sticky["current_stick"] = p.get_json_data("Design", "currentstick")
    current_index = int(sticky["current_stick"])

print type(current_index)
# ---------- end read ----------
currentstick = Panel(read.current_index)

# ----
# ROS client
list_2 = ValueList({"local": "127.0.0.1", "linux computer": "192.168.0.42", "linux eduroam": "10.181.95.254", "robot": "192.168.0.200"}, selected="local")
connect_2 = BooleanToggle(True)
ros = ROSConnect(ip=list_2, port="9090", connect=connect_2)  # -> ros_client, is_connected; inputs port: Int32, connect: Boolean
#   port ip: The ip address ROS. Defaults to 127.0.0.1.
#   port port: The port of ROS. Defaults to 9090.
#   port connect: If True, connects to ROS. If False, disconnects from ROS. Defaults to False.
#   port ros_client: The ROS client.
#   port is_connected: True if connection established.
# ---------- ros: Python ----------
"""
Connect or disconnect to ROS.

COMPAS FAB v0.27.0
"""
from ghpythonlib.componentbase import executingcomponent as component
from scriptcontext import sticky as st

from compas_fab.backends import RosClient
from compas_fab.ghpython.components import create_id


class ROSConnect(component):
    def RunScript(self, ip, port, connect):
        ros_client = None

        ip = ip or '127.0.0.1'
        port = port or 9090

        key = create_id(self, 'ros_client')
        ros_client = st.get(key, None)

        if ros_client:
            st[key].close()
        if connect:
            st[key] = RosClient(ip, port)
            st[key].run(5)

        ros_client = st.get(key, None)
        is_connected = ros_client.is_connected if ros_client else False
        return (ros_client, is_connected)
# ---------- end ros ----------
panel_8 = Panel(ros.is_connected)

# ----
# Load assembly model
# Import assembly from .json.
import = Button(ExpressionNormal="True", ExpressionPressed="False")
initial_assembly = GhPythonScript(DATA=py_3.DATA, filename="full_assembly.json", import_from_json=import)  # -> out, assembly; inputs import_from_json: Boolean
# ---------- initial_assembly: Python ----------
import os
import json
from scriptcontext import sticky

from cdf_2023.assembly import Assembly

if import_from_json:
    PATH = os.path.join(DATA, "assembly", filename)
    assembly = Assembly.from_json(PATH)
    assembly.support_keys = []

# create a dictionary to store global value in 
assembly.globals = {}

# define global values
assembly.globals['rod_radius'] = 0.011
assembly.globals['rod_length'] = 0.6
assembly.globals['rf_unit_offset'] = 0.2
assembly.globals['rf_unit_radius'] = 0.15

print assembly.element(35).trajectory
# ---------- end initial_assembly ----------

panel_9 = Panel(py_3.ENVIRONMENT_NAME)

# ----
# IP Settings
# --> Set your IP address
# --> Set robot IP address
server_ip = ValueList({"192.168.0.48", "192.168.10.12", "192.168.10.11", "192.168.10.10", "192.168.10.2", "127.0.0.1", "192.168.10.111", "192.168.0.250", "192.168.0.30", "10.42.0.212", "10.42.0.133"}, selected="192.168.0.48")
ext_ip = ValueList({"192.168.10.10", "192.168.10.20", "192.168.10.11", "192.168.10.12", "127.0.0.1", "192.168.10.111", "192.168.0.220", "192.168.0.30", "192.168.10.50", "0.0.0.0"}, selected="192.168.0.220")
ur_ip = ValueList({"192.168.10.10", "192.168.10.20", "192.168.10.11", "192.168.10.12", "127.0.0.1", "192.168.10.111", "192.168.0.210", "192.168.0.30"}, selected="192.168.0.210")
server_port = ValueList({"50002", "50003", "50005", "50006", "50007", "50008", "50009", "50010", "50011", "50012", "50013", "50014", "50015", "50016", "50017", "50018", "50019", "50020", "50021", "50022", "50023", "50024", "50025", "50026", "50027", "50028"}, selected="50007")
ext_port = ValueList({"50003", "50004"}, selected="50004")
ur_port = ValueList({"30002"}, selected="30002")
globals = PythonScript(
    server_ip=server_ip,
    server_port=server_port,
    ur_ip=ur_ip,
    ur_port=ur_port,
    ext_ip=ext_ip,
    ext_port=ext_port,
    clear=Button())  # inputs server_port: Int32
# ---------- globals: Python ----------
from scriptcontext import sticky as st

st["server_ip"] = server_ip
st["server_port"] = server_port

st["ur_ip"] = ur_ip
st["ur_port"] = ur_port

st["ext_ip"] = ext_ip
st["ext_port"] = ext_port


if clear:
    st.clear()
# ---------- end globals ----------

# ----
# Check if UR robot
#  is available
ping = Button()
py_4 = PythonScript(ip=ur_ip, ping=ping)  # -> out, trigger
# ---------- py_4: Python ----------
from scriptcontext import sticky as st
from ur_fabrication_control.direct_control.utilities import is_available

guid = str(ghenv.Component.InstanceGuid)
txt_key = "txt_" + guid
if txt_key not in st:
    st[txt_key] = ""

if ping:
    
    available = is_available(ip)
    
    if available:
        st[txt_key] = "%s is up!" % ip
        trigger = True
    else:
        st[txt_key] = "%s is down!" % ip
        trigger = False

print(st[txt_key])
# ---------- end py_4 ----------
panel_10 = Panel(py_4.out)

# ----
# Load robot from ROS
# Load robot from ROS
load_2 = Button()
robot = ROSRobot(ros_client=ros.ros_client, load=load_2)  # -> mobile_robot; inputs load: Boolean
#   port ros_client: The ROS client.
#   port load: If True, loads the robot from ROS. Defaults to False.
# ---------- robot: Python ----------
"""
Load robot directly from ROS.

COMPAS FAB v0.27.0
"""
from mobile_robot_control.mobile_robot import MobileRobot
from mobile_robot_control.mobile_robot_client import MobileRobotClient

from compas_ghpython.artists import RobotModelArtist
from ghpythonlib.componentbase import executingcomponent as component
from scriptcontext import sticky as st

from compas_fab.ghpython.components import create_id


class ROSRobot(component):
    def RunScript(self, ros_client, prefix, load):
        key = create_id(self, 'robot')

        if ros_client and ros_client.is_connected and load:
            # Load URDF from ROS
            robot = ros_client.load_robot(
                    load_geometry=True, 
                    urdf_param_name= '{}/robot_description'.format(prefix),
                    srdf_param_name= '{}/robot_description_semantic'.format(prefix),
                    precision='12f')
            robot.artist = RobotModelArtist(robot.model)
            mobile_robot = MobileRobot(robot.model, robot.artist, robot.semantics, client=None, wheel_type="indoor")
            st[key] = mobile_robot

        mobile_robot = st.get(key, None)
        if mobile_robot:  # client sometimes need to be restarted, without needing to reload geometry
            mobile_robot.mobile_client = MobileRobotClient(ros_client)
            mobile_robot.client = ros_client
        return mobile_robot
# ---------- end robot ----------

list_3 = ValueList({"ur10e", "ur10e_and_liftkit"}, selected="ur10e")

# ----
# 6. Load from planned assembly
panel_11 = Panel("047_plan_paths_assembly.json")  # disabled
number_slider = Slider(10, range=0..20)  # disabled
toggle_2 = BooleanToggle(True)  # disabled
python_2 = GhPythonScript(filename=panel_11, read=toggle_2, upto=number_slider)  # -> out, assembly, configurations; inputs upto: Int32; disabled
# ---------- python_2: Python ----------
import os
from assembly_information_model.assembly import Assembly

filepath = os.path.join(data_path, filename)

if os.path.isfile(filepath):
    assembly = Assembly.from_json(filepath)
    configurations = []
    #for key in assembly.network.nodes():
    for key in range(upto):
        element = assembly.element(key)
        if element.trajectory:
            trajectory_points = []
            for trajectory in element.trajectory:
                trajectory_points += trajectory.points
            configurations += trajectory_points
            trajectory_points.reverse()
            configurations += trajectory_points
# ---------- end python_2 ----------

key = Slider(70, range=0..388)
till_key = Button()
reset_2 = Button()
start = Button()
stop = Button()
step = Button()
full = Button()
list_4 = ValueList({"20", "50", "100", "500", "1000", "5000"}, selected="50")

back = Button()
counter = CountThroughList(
    assembly=initial_assembly.assembly,
    start=start,
    stop=stop,
    step=step,
    step_back=back,
    reset=reset_2,
    full=full,
    till_key=till_key,
    key=key,
    interval=list_4)  # -> item, counter; inputs start: Boolean, stop: Boolean, step_back: Boolean, key: Int32
# ---------- counter: Python ----------
from scriptcontext import sticky as st
from compas_ghpython import update_component


L = list(assembly.elements())
# store data in component
guid = str(ghenv.Component.InstanceGuid)
counter_key = "counter_" + guid
running_key = "running_" + guid

if counter_key not in st:
    st[counter_key] = 0

if running_key not in st:
    st[running_key] = False
    

if st[running_key]:
    if st[counter_key] < len(L) - 1:
        st[counter_key] += 1
        update_component(ghenv, interval)
    else:
        st[counter_key] = 0
        st[running_key] = False
    
    
if start:
    st[running_key] = True

if stop:
    st[running_key] = False

if step:
    if st[counter_key] < len(L) - 1:
        st[counter_key] += 1

if step_back:
    if st[counter_key] < len(L):
        st[counter_key] -= 1

if reset:
    st[counter_key] = 0

if till_key:
    st[counter_key] = key

if full:
    st[counter_key] = len(L)-1

if len(L):
    item = L[st[counter_key]]



#st["visualisation_counter"] = st[counter_key]
#st[counter_key]= 500
counter = st[counter_key]
# ---------- end counter ----------

# ----
# ROS client
connect_3 = Button()
disconnect = Button()
list_5 = ValueList({"local": "127.0.0.1", "linux computer": "192.168.0.42", "linux eduroam": "10.181.95.254", "robot": "192.168.0.200"}, selected="local")
connect_4 = PythonScript(robot=create.robot, ip=list_5, connect=connect_3, disconnect=disconnect)  # -> out, robot
# ---------- connect_4: Python ----------
import sys
import scriptcontext as sc
from compas_fab.backends import RosClient
from mobile_robot_control.mobile_robot_client import MobileRobotClient

if robot:
    if connect:
        ros_client = RosClient(host=ip, port=9090)
        robot.client = ros_client
        robot.mobile_client = MobileRobotClient(ros_client)
        robot.mobile_client.connect()
    
    if disconnect:
        robot.mobile_client.disconnect()
        
    print('ROS connected: {}'.format(robot.mobile_client.ros_client.is_connected))
# ---------- end connect_4 ----------
is_connected = Panel(connect_4.out)

counter_2 = Panel(counter.counter)

trigger = Trigger(Interval=100, TimerInterval=100, Target=fabrication_state)  # disabled
fabrication_state = PythonScript()  # -> out, state, num_tasks, num_current_task, num_tasks_left, log_messages
# ---------- fabrication_state: Python ----------
from scriptcontext import sticky as st

fabrication = st["fabrication"]

if hasattr(fabrication, "task_thread"):
    if fabrication.task_thread.is_alive():
        state = "THREAD RUNNING"
    else:
        state = "THREAD STOPPED"

num_tasks = len(fabrication.tasks)
if fabrication.current_task_key is not None:
    num_current_task = fabrication.current_task_key+1
else:
    num_current_task = 0
num_tasks_left = num_tasks-num_current_task
log_messages = fabrication.log_messages
# ---------- end fabrication_state ----------
num_current_task = Panel(fabrication_state.num_current_task)
state = Panel(fabrication_state.state)
num_tasks = Panel(fabrication_state.num_tasks)
num_tasks_left = Panel(fabrication_state.num_tasks_left)
log_messages = Panel(fabrication_state.log_messages)

bcf_wcs_aa_0 = Plane(Plane(origin=(-1.120016737, -0.4177832486, 0.02507495815), x=(0.5635332502, -0.8258776449, -0.01887833521), y=(0.8260719597, 0.5635360475, 0.005678077874)))
bcf_wcs_ab_0 = Plane(Plane(origin=(0.9896612368, 0.9287122403, 0.007218178072), x=(-0.9475576884, 0.3195482043, -0.004834489242), y=(-0.3195383255, -0.9475694642, -0.002714584304)))

stats = GhPythonScript(assembly=initial_assembly.assembly)  # -> out
# ---------- stats: Python ----------
total_elements = assembly.network.number_of_nodes()
planned_keys = list(assembly.network.nodes_where({'is_planned':True}))
built_keys = list(assembly.network.nodes_where({'is_built':True}))
support_keys = list(assembly.network.nodes_where({'is_support':True}))

print total_elements, "element(s) in assembly."
print len(built_keys), "element(s) are already built."
print len(planned_keys), "element(s) are planned."
print len(support_keys), "element(s) are suppports."
# ---------- end stats ----------
numbers = Panel(stats)

bcf_wcs_aa_0_corr = Plane(Plane(origin=(-1.132427079, -0.3732620659, 0.01940490754), x=(0.536931495, -0.8436251276, 0.001101673576), y=(0.8436036951, 0.5369074752, -0.007947878686)))
bcf_wcs_aa_0_corr3 = Plane(Plane(origin=(-1.117452192, -0.4208430177, 0.01980614689), x=(0.5723915496, -0.8199742309, 0.003189757304), y=(0.8199580906, 0.5723429035, -0.009608873971)))

start_2 = Button()  # disabled
stop_2 = Button()  # disabled
reset_3 = Button()  # disabled
stop_3 = Button()  # disabled
counter_3 = CountThroughList(start=start_2, stop=stop_2, step=False, back=stop_3, reset=reset_3, interval=1)  # -> item; inputs L: list, start: Boolean, stop: Boolean; disabled
# ---------- counter_3: Python ----------
from scriptcontext import sticky as st
from compas_ghpython.utilities import update_component

if not interval:
    interval = 5

# store data in component
guid = str(ghenv.Component.InstanceGuid)
counter_key = "counter_" + guid
running_key = "running_" + guid

if counter_key not in st or reset:
    st[counter_key] = 0

if running_key not in st:
    st[running_key] = False


    

if start:
    st[running_key] = True

if stop:
    st[running_key] = False

if step:
    if st[counter_key] < len(L) - 1:
        st[counter_key] += 1

if back:
    if st[counter_key] > 1:
        st[counter_key] -= 1

if len(L):
    item = L[st[counter_key]]

if st[running_key]:
    if st[counter_key] < len(L) - 1:
        st[counter_key] += 1
        update_component(ghenv, interval)
    else:
        st[counter_key] = 0
        st[running_key] = False
# ---------- end counter_3 ----------

show = BooleanToggle(True)

# ----
# Assembly visualization
# 1. Visualize assembly.
# 2. Visualize selected element.
# 3. Visuilize built/planned and supports.
show_2 = BooleanToggle(False)
show_3 = BooleanToggle(False)
show_4 = BooleanToggle(True)
show_5 = BooleanToggle(False)
show_6 = BooleanToggle(False)
# Configuration
number_slider_2 = Slider(109, range=0..360)  # disabled
assembly_viz = PythonScript(
    assembly=initial_assembly.assembly,
    show_assembly=show_2,
    show_built=show_3,
    show_supports=show_5,
    show_selected=show_4,
    show_counter=show,
    show_keys=show_6,
    current_key=counter.counter)  # -> out, G_placed_by_robot, G_placed_by_human, G_elements, G_selected, key_tag_location, key_tag_text, robot_base_plane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; inputs current_key: Int32
# ---------- assembly_viz: Python ----------
import os
import sys
from scriptcontext import sticky as st
import Rhino.Geometry as rg

import math

from compas.artists import Artist
from compas.colors import Color
from compas_ghpython import draw_frame
from compas_rhino.conversions import cylinder_to_rhino, frame_to_rhino

G_elements = []
G_placed_by_robot = []
G_placed_by_human = []

flip = 'AA'

key_tag_text = []
key_tag_location= []

# Color coding
color_coding = {'color_close_pairs': Color(1.0, 0., 0.0, 1.0),
                'color_is_planned': Color(1.0, 0.752941176471, 0.0, 1.0), 
                'color_is_support': Color(0.0, 0.0, 1.0, 1.0), 
                'color_has_open_connector': Color(0.494117647059, 1.0, 0.239215686275, 1.0), 
                'color_has_no_open_connectors': Color(0.78431372549, 0.78431372549, 0.78431372549, 1.0), 
                'color_is_built': Color(0.811764705882, 1.0, 0.709803921569, 1.0), 
                'color_is_built_by_robot': Color(0.686274509804, 0.878431372549, 0.862745098039, 1.0), 
                'color_is_built_by_human': Color(0.949019607843, 0.898039215686, 0.0, 1.0)}


def show(element, output_geo, color):
    mesh = Artist(element.mesh).draw(color)
    output_geo.append(mesh)

def show_multiple(elements, output_geo, color):
    for element in elements:
        mesh = Artist(element.mesh).draw(color)
        output_geo.append(mesh)

key_index = assembly.network.key_index()
keys = [key_index[key] for key in assembly.network.nodes()]
elements = [assembly.element(key) for key in keys]

robot_keys = list(assembly.network.nodes_where({'placed_by':'robot'}))
human_keys = list(assembly.network.nodes_where({'placed_by':'human'}))

robot_elements = [assembly.element(key) for key in robot_keys] 
human_elements = [assembly.element(key) for key in human_keys] 

if assembly:
    radius = assembly.globals['rod_radius']
    
    if current_key != None:
        current_element = assembly.element(current_key)
    else:
        current_element = None
        
    if show_selected: 
        G_selected = cylinder_to_rhino(assembly.element(current_key)._source)
        
    # Visualize assembly
    if show_assembly:
        for element in robot_elements:
            geo = cylinder_to_rhino(element._source)
            G_placed_by_robot.append(geo)
            
        for element in human_elements:
            geo = cylinder_to_rhino(element._source)
            G_placed_by_human.append(geo)


    selected_elem_plane = draw_frame(assembly.element(current_key).frame)
    
    if show_keys:
        for key, element in assembly.elements():
            if key < current_key+1:
                key_tag_text.append(str(key))
                key_tag_location.append(Artist(element.frame).draw().Origin)
    
if show_counter and not show_assembly:
    for element in elements[0:current_key+1]:
        geo = cylinder_to_rhino(element._source)
        G_elements.append(geo)
    
if assembly.network.node_attribute(current_key, 'robot_AA_base_frame') != False and assembly.network.node_attribute(current_key, 'robot_AB_base_frame') != False:
    robot_AA_base_plane = draw_frame(assembly.network.node_attribute(current_key, 'robot_AA_base_frame'))
    robot_AB_base_plane = draw_frame(assembly.network.node_attribute(current_key, 'robot_AB_base_frame'))
    robot_name = assembly.network.node_attribute(current_key, 'robot_name')
# ---------- end assembly_viz ----------
rot = GhPythonScript(plane=assembly_viz.selected_elem_plane, angle=number_slider_2)  # -> out, plane; disabled
# ---------- rot: Python ----------
import math
from compas.geometry import Frame, Rotation
from compas.artists import Artist

frame = Frame(plane.Origin, plane.XAxis, plane.YAxis)

R = Rotation.from_axis_and_angle(frame.xaxis, math.radians(angle), frame.point)
frame.transform(R)

plane = Artist(frame).draw()
# ---------- end rot ----------
tag = TextTag(Location=assembly_viz.key_tag_location, Text=assembly_viz.key_tag_text)
geo = Geometry(assembly_viz.G_selected)
geo_2 = Geometry(assembly_viz.G_placed_by_human)
geo_3 = Geometry(assembly_viz.G_placed_by_robot)
geo_4 = Geometry(assembly_viz.G_elements)
preview_2 = CustomPreview(Geometry=geo, Material=ColourSwatch(SwatchColor=RGB(0, 0, 255)))
preview_3 = CustomPreview(Geometry=geo_2, Material=ColourSwatch(SwatchColor=RGB(242, 229, 0)))
preview_4 = CustomPreview(Geometry=geo_3, Material=ColourSwatch(SwatchColor=RGB(175, 224, 220)))
preview_5 = CustomPreview(Geometry=geo_4, Material=ColourSwatch(SwatchColor=RGBA(199, 199, 199, 89)))

shift_value = Slider(0.24, range=-0.25..0.25)
l = Slider(0.3, range=0..0.72)
approach_plane_top = Plane(Plane(origin=(-1.187685767, -1.00513099, 2.409582425), x=(-0.02094047858, -0.5758988517, -0.8172527204), y=(0.06174631941, -0.8166164791, 0.5738683805)))  # disabled
approach_plane_left = Plane(Plane(origin=(-1.285048766, -1.395245102, 0.9388493092), x=(-0.368867444, 0.3715653368, -0.8519835733), y=(0.709678534, 0.7045256407, 0)))  # disabled
list_6 = ValueList({"ur10e", "ur10e_and_liftkit"}, selected="ur10e")
pln = Plane(Plane(origin=(1.221977133, 1.294710655, 1.014515308), x=(-0.9475576884, 0.3195482043, -0.004834489242), y=(0.3195383255, 0.9475694642, 0.002714584304)))  # disabled
pln_2 = Plane(assembly_viz.robot_AA_base_plane)
pln_3 = Plane(assembly_viz.robot_AB_base_plane)
robot_ab_base_plane = Plane(pln_3)

# ----
# Network visualization
number_slider_3 = Slider(0, range=0..47)
show_7 = BooleanToggle(False)
network_viz = GhPythonScript(assembly=initial_assembly.assembly, show_network=show_7, key=number_slider_3)  # -> out, nodes, edges, current_node, current_node_neighbors; inputs key: Int32
# ---------- network_viz: Python ----------
import sys, os
import ghpythonlib.components as ghcomp
from compas.datastructures import Network
from compas_ghpython.artists import NetworkArtist
from compas_rhino.geometry import RhinoLine

import compas_ghpython
import Rhino.Geometry as rg


data = assembly.network.to_data()
network = Network.from_data(data)

print assembly.network.number_of_nodes()

def draw_network(network):
    """Draw a network in Grasshopper.
    """
    points = []
    for key, attr in network.nodes(True):
        points.append({
            'pos': network.node_coordinates(key),
        })

    lines = []
    for (u, v), attr in network.edges(True):
        lines.append({
            'start': network.node_coordinates(u),
            'end': network.node_coordinates(v),
        })

    points_rg = compas_ghpython.draw_points(points)
    lines_rg = compas_ghpython.draw_lines(lines)

    return points_rg, lines_rg

if show_network:
    nodes, edges = draw_network(network)
    
    current_node = {'pos': network.node_coordinates(key), 'radius': 0.03}
    current_node = compas_ghpython.draw_spheres([current_node])
    
    current_node_neighbors_keys = network.neighbors(key)
    current_node_neighbors = [{'pos': network.node_coordinates(key), 'radius': 0.02} for key in current_node_neighbors_keys]
    current_node_neighbors = compas_ghpython.draw_spheres(current_node_neighbors)
# ---------- end network_viz ----------
pt = Point(network_viz.nodes)
line = Line(network_viz.edges)
brep = Brep(network_viz.current_node)
brep_2 = Brep(network_viz.current_node_neighbors)
preview_6 = CustomPreview(Geometry=brep_2, Material=ColourSwatch(SwatchColor=RGB(255, 207, 207)))
preview_7 = CustomPreview(Geometry=[brep, line], Material=ColourSwatch(SwatchColor=RGB(0, 0, 0)))

# ---- group: capture
viewport_name = Text("workflow_2")
capture_to_bitmap = PythonScript(DATA=py_3.DATA, capture=Button(), viewport_name=viewport_name, idx=Slider(2, range=0..10))  # -> out, a; inputs capture: Boolean, idx: Int32
# ---------- capture_to_bitmap: Python ----------
import Rhino
import System.Drawing
from scriptcontext import sticky as st

import sys, os
import ghpythonlib.components as ghcomp
import Grasshopper as gh
import datetime


ghComp = ghenv.Component
ghDoc = ghComp.OnPingDocument()

def rCommonCap(filePath, viewportName,scaleFactor):
    RhinoDocument = Rhino.RhinoDoc.ActiveDoc
    view = RhinoDocument.Views.Find(viewportName, False)
    vp = view.ActiveViewport
    size = System.Drawing.Size(vp.Size.Width*scaleFactor,vp.Size.Height*scaleFactor)
    capture = view.CaptureToBitmap(size)
    capture.Save(filePath);


export_dir = os.path.join(DATA, 'parameter_studies')
if not os.path.isdir(export_dir): os.mkdir(export_dir)
print export_dir
filename = os.path.join(export_dir, 'capture_' + str(idx) + '.png') 
print filename

zoom = 1

if capture:
    rCommonCap(filename, viewport_name, zoom)
# ---------- end capture_to_bitmap ----------

# ----
# Export .json
export = Button()
export_2 = Button()
export_3 = PythonScript(DATA=py_3.DATA, assembly=initial_assembly.assembly, export_to_json=export, export_to_json_unity=export_2)
# ---------- export_3: Python ----------
import os
from compas.datastructures.mesh import mesh_quads_to_triangles
from compas.datastructures.mesh import mesh_unify_cycles

if export_to_json:
    filename = "assembly_example_02.json"
    PATH = os.path.join(DATA, "assembly", filename)
    
    # the assembly has to be serialized such that it can be called from CPython, True to enable pretty print
    assembly.to_json(PATH, True)
    

if export_to_json_unity:
    
    for key, e in assembly.elements():
    
        #convert to trimesh
        mesh_quads_to_triangles(e._mesh, check_angles=False)
        #mesh_unify_cycles(e._mesh)
        #print e._mesh.faces
        #print e._mesh.face_vertices(list(e._mesh.faces())[0])

    filename = "unity_assembly_test.json"
    PATH = os.path.join(DATA, "assembly", filename)
    assembly.to_json(PATH)
# ---------- end export_3 ----------

show_robot_frame = BooleanToggle(False)

# ----
# Get 'robot AB' frame
# from Realtime Database
connect_5 = BooleanToggle(False)
get_2 = Button()
read_robot_ab = PythonScript(path=data, current_index=read.current_index, get_robot_base_frame=get_2, connect=connect_5)  # -> robot_AB_base_frame; inputs current_index: Int32, connect: Boolean
# ---------- read_robot_ab: Python ----------
import os
import compas
from compas.rpc import Proxy
from compas_rhino.conversions import plane_to_compas_frame

robot_name ="AA"

if connect:
    p = Proxy(package = 'cdf_2023.firebase.realtime_database', path=path +'\src')
    p.stop_server()
    p.start_server()

#    if get_robot_base_frame:
#        sticky["current_stick"] = p.get_json_data("Design", "currentstick")
#    current_index = int(sticky["current_stick"])
# ---------- end read_robot_ab ----------

# ----
# Viz robot AB
robot_ab_mesh = Mesh([<mesh referenced from the Rhino model> x48])
bcf_wcs_ab_0_2 = Plane(Plane(origin=(0.9896612368, 0.9287122403, 0.007218178072), x=(-0.9475576884, 0.3195482043, -0.004834489242), y=(-0.3195383255, -0.9475694642, -0.002714584304)))
python_3 = GhPythonScript(robot_meshes=robot_ab_mesh, plane=bcf_wcs_ab_0_2)  # -> out, robot_transformed; inputs robot_meshes: list of Mesh
# ---------- python_3: Python ----------
from compas.geometry import Transformation, Frame
from compas_rhino.conversions import RhinoMesh
from compas.artists import Artist

robot_frame = Frame(plane.Origin, plane.XAxis, plane.YAxis)
T = Transformation.from_frame_to_frame(Frame.worldXY(), robot_frame)

robot_transformed = []

for mesh in robot_meshes:
    compas_mesh = RhinoMesh.from_geometry(mesh).to_compas()
    compas_mesh.transform(T)
    robot_transformed.append(Artist(compas_mesh).draw())
# ---------- end python_3 ----------
mesh = Mesh(python_3.robot_transformed)

start_3 = Button()
stop_4 = Button()
back_2 = Button()
reset_4 = Button()
step_2 = Button()

# ----
# Stop
stop_5 = Button()
stop_6 = PythonScript(stop=stop_5)
# ---------- stop_6: Python ----------
from scriptcontext import sticky as st
from ur_fabrication_control.direct_control.common import send_stop

ur_ip = st["ur_ip"]
ur_port = st["ur_port"]

if stop:
    send_stop(ur_ip, ur_port)
# ---------- end stop_6 ----------

# ----
# EXCEL READER
panel_12 = Panel("ARCHITEKTEN0724")
read_2 = BooleanToggle(True)
path = FilePath("C:\Users\lidet\workspace\projects\cdf_2023\data\markers\measurement\RoboterLabor2023_2003.xlsx")
excelread = ExcelReader(ReadExcelData=read_2, WorkbookPath=path, WorksheetName=panel_12)  # -> Exceptions, ExcelData

panel_13 = Panel("-0.01")  # disabled
Z = UnitZ(Factor=panel_13)  # disabled

# ----
# Parallel Gripper Switch
open = BooleanToggle(True)
digital_out = PythonScript(open=open)  # -> urscript
# ---------- digital_out: Python ----------
from ur_fabrication_control.direct_control import URScript
from ur_fabrication_control.direct_control.mixins import ParallelGripMixins

class URScript_ParallelGrip(URScript, ParallelGripMixins):
    pass

urscript = URScript_ParallelGrip()
urscript.start()

if open:
    # Open State
    urscript.parallelgrip_open()
else: 
    # Closed State
    urscript.parallelgrip_close()

urscript.end()
urscript = urscript.generate()
print(urscript)
# ---------- end digital_out ----------
send = Button()
send_2 = GhPythonScript(urscript=digital_out, send=send)  # -> out; inputs send: Boolean
# ---------- send_2: Python ----------
from scriptcontext import sticky as st
from ur_fabrication_control.direct_control import send_script

ur_ip = st["ur_ip"]
ur_port = st["ur_port"]

print ur_ip

if send:
    send_script(urscript, ur_ip, ur_port)
# ---------- end send_2 ----------

pln_4 = Plane([Plane(origin=(-3.196288424, -1.171423355, -0.001336994863), x=(0.9993651487, -0.03468731755, -0.00812954397), y=(0.03487769912, 0.9990892498, 0.02458082464)), Plane(origin=(-1.527429313, -1.213134511, -0.0007293064632), x=(0.9994587579, -0.02655739148, 0.0194138162), y=(0.02672054382, 0.9996093644, -0.008193356866)), Plane(origin=(0.05688082564, -1.260234049, 0.003024378437), x=(0.9996471573, -0.02656239758, 0), y=(0.02656156106, 0.9996156758, 0.007936257995)), Plane(origin=(1.850488639, -1.310211415, 0.008700117744), x=(0.9998502458, -0.01730566356, 0), y=(0.01730317854, 0.9997066716, 0.01694611542)), Plane(origin=(3.361802525, -1.345063562, 0.003412023821), x=(0.9996220175, -0.02656172957, -0.007092020222), y=(0.02670016894, 0.9994394363, 0.02019688334)), Plane(origin=(-3.173791039, 0.1654833765, 0.000429159087), x=(0.9994026777, -0.03455846899, 0), y=(0.03455846899, 0.9994026777, 0))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])  # disabled

# ----
# Stop
stop_7 = Button()
stop_8 = PythonScript(stop=stop_7)  # same code as stop_6

move = Move(Geometry=pln_4, Motion=Z)  # -> Geometry, Transform; disabled

# ---- group: Internalized Excel Data
data_2 = Data(Tree({0}: ["Punktname", "1A0", "1AX", "1AY", "1B0", "1BX", "1BY", "1C0", "1CX", "1CY"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], {1}: ["X [m]", "0", "0.123", "0.001", "1.67", "1.773", "1.67", "3.255", "3.376", "3.256"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], {2}: ["Y [m]", "0", "-0.001", "0.122", "0.002", "0.002", "0.124", "-0.003", "-0.003", "0.123"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], {3}: ["Höhe [m]", "0", "-0.001", "0.003", "0.001", "0.003", "0", "0.005", "0.005", "0.006"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]))

# ----
rectangle = Rectangle(Plane=move.Geometry, XSize=Domain(-0.075, 0.075), YSize=Domain(-0.075, 0.075), Radius=0)  # -> Rectangle, Length; disabled

# ----
# FRAMES as measured
python_4 = GhPythonScript(data=data_2)  # -> out, measured_planes; inputs data: tree
# ---------- python_4: Python ----------
import ghpythonlib.treehelpers as tr
import Rhino.Geometry as rg


data = tr.tree_to_list(data, lambda x:x)

# Extract point names and coordinates
point_names = data[0][1:-9]
x_values = [float(x) for x in data[1][1:-9]]
y_values = [float(y) for y in data[2][1:-9]]
z_values = [float(z) for z in data[3][1:-9]]

# Create a list to hold the grouped points
grouped_names =[]
grouped_points = []

i=-1
for name, x, y, z in zip(point_names, x_values, y_values, z_values):
    number = name[0:2] # Extract the number from the point name
    
    if number not in grouped_names:
        
        grouped_names.append(number)
        grouped_points.append([])
        i+=1
        
    grouped_points[i].append([x, y, z])


#Create planes from grouped points
measured_planes = []
origin_pts =[]

for i, points in enumerate(grouped_points):
    
    origin_pt = rg.Point3d(points[0][0], points[0][1], points[0][2])
    x_pt = rg.Point3d(points[1][0], points[1][1], points[1][2])
    y_pt = rg.Point3d(points[2][0], points[2][1], points[2][2])
    
    plane = rg.Plane(origin_pt,x_pt, y_pt)
    
    origin_pts.append(origin_pt)
    measured_planes.append(plane)


print origin_pts, measured_planes
# ---------- end python_4 ----------

# ----
# ArUco Frames
python_5 = GhPythonScript(measured_planes=python_4.measured_planes)  # -> out, translated_planes, aruco_planes; inputs measured_planes: list of Plane
# ---------- python_5: Python ----------
import ghpythonlib.treehelpers as tr
import Rhino.Geometry as rg

translated_planes = []

for m_plane in measured_planes:

    T1 = rg.Transform.Translation(m_plane.XAxis * 0.075)
    T2 = rg.Transform.Translation(m_plane.YAxis *  0.075)
    
    center = m_plane.Origin
    center.Transform(T1*T2)
    
    aruco_plane = rg.Plane(center, m_plane.XAxis, m_plane.YAxis)
    translated_planes.append(aruco_plane)


aruco_planes = translated_planes[:-3]
# ---------- end python_5 ----------

foundation_origin_real = Plane(Plane(origin=(3.259664405, 1.330283844, 0.002570840913), x=(0.9999999257, 0.0003855833507, 0), y=(-0.0003855833507, 0.9999999257, 0)))

# ----
# QR Frames
panel_14 = Panel("""0
2
4
5
8
9
11
13""")
python_6 = GhPythonScript(translated_planes=python_5.translated_planes, aruco_planes=python_5.aruco_planes, list=panel_14)  # -> out, qr_planes; inputs translated_planes: list of Plane, aruco_planes: list of Plane, list: list of Int32
# ---------- python_6: Python ----------
import ghpythonlib.treehelpers as tr
import Rhino.Geometry as rg

planes = []

for m_plane in aruco_planes:

    T1 = rg.Transform.Translation(m_plane.XAxis * 0.15)
    
    center = m_plane.Origin
    center.Transform(T1)
    
    qr_plane = rg.Plane(center, m_plane.XAxis, m_plane.YAxis)
    planes.append(qr_plane)

qr_planes=[]

for i in list:
    qr_planes.append(planes[i])

qr_planes.append(translated_planes[14])
qr_planes.append(translated_planes[15])
qr_planes.append(translated_planes[16])
# ---------- end python_6 ----------
pln_5 = Plane(python_6.qr_planes)

# ----
# Markers
foundation_origin_test = Plane(PlaneXY(3.260800604, 1.459516192, 0.05))  # disabled
pln_6 = Plane(python_5.aruco_planes)
python_7 = GhPythonScript(plane=foundation_origin_real, planes=pln_6)  # -> out, planes_trnsf; inputs planes: list
# ---------- python_7: Python ----------
import rhinoscriptsyntax as rs
from compas.geometry import Frame, Transformation
from compas_rhino.conversions import plane_to_compas_frame
from compas_ghpython import draw_frame

frame = Frame(plane.Origin, plane.XAxis, plane.YAxis)
T = Transformation.from_frame_to_frame(frame, Frame.worldXY())

frames_trnsf = []

for plane in planes:
    frame = plane_to_compas_frame(plane)
    frame.transform(T)
    frames_trnsf.append(frame)

planes_trnsf = [draw_frame(f) for f in frames_trnsf]
# ---------- end python_7 ----------
pln_7 = Plane(python_7.planes_trnsf)
rectangle_2 = Rectangle(Plane=pln_7, XSize=Domain(-0.075, 0.075), YSize=Domain(-0.075, 0.075), Radius=0)  # -> Rectangle, Length
python_8 = GhPythonScript(plane=foundation_origin_real, planes=pln_5)  # -> out, planes_trnsf; inputs planes: list; same code as python_7
pln_8 = Plane(python_8.planes_trnsf)
rectangle_3 = Rectangle(Plane=pln_8, XSize=Domain(-0.075, 0.075), YSize=Domain(-0.075, 0.075), Radius=0)  # -> Rectangle, Length

rcf_wcs_aa_0_corr = Plane(Plane(origin=(-0.978529, -0.599953, 1.040675), x=(0.2168499922, 0.9761839651, -0.006398999771), y=(-0.9761857946, 0.216882132, 0.004840998058)))
rcf_wcs_ab_0 = Plane(Plane(origin=(0.72352, 1.015539, 1.036873), x=(0.4440767502, -0.895987496, 0.001498999157), y=(0.8959721839, 0.4440780916, 0.005338001096)))
rcf_wcs_aa_0 = Plane(Plane(origin=(-0.959851, -0.793691, 1.050685), x=(0.1852640663, 0.9825353515, 0.01736400621), y=(-0.9826707211, 0.1851246348, 0.009333991474)))
rcf_wcs_aa_0_corr2 = Plane(Plane(origin=(-0.947287, -0.645284, 1.041652), x=(0.1776430124, 0.9840900686, -0.003114000217), y=(-0.983993014, 0.1776692681, 0.01383400004)))
rcf_wcs_aa_0_corr3 = Plane(Plane(origin=(-0.953864, -0.63805, 1.041631), x=(0.17505598, 0.9845168873, -0.009049998964), y=(-0.9845398724, 0.1751017909, 0.004539000925)))

# ----
# Attach tool
list_7 = ValueList({"measurement_tool": 0, "area_gripper": 1, "parallel_gripper": 2, "parallel_gripper_with_mtip": 3}, selected="parallel_gripper")
show_8 = BooleanToggle(True)
remove = Button()
add = Button()
py_5 = PythonScript()  # -> DATA
# ---------- py_5: Python ----------
import os

#package_path = os.path.dirname(mobile_fabrication_control.__file__)
#DATA = os.path.abspath(os.path.join(package_path,"../../data"))

package_path = ghdoc.Path
# package_path = os.path.dirname(ur_fabrication_control.__file__)
#DATA = os.path.abspath(os.path.join(package_path,"../../data"))

# .stl files not stored in am_hackathon repo. but in mobile_fabrication_control
DATA = os.path.abspath(os.path.join(package_path,"../../../mobile_robot_control/data"))

print(package_path)
print(DATA)
# ---------- end py_5 ----------
tool = PythonScript(data_path=py_5, tool=list_7, show=show_8)  # -> tool, M, ee_plane
# ---------- tool: Python ----------
import os, math
from compas.geometry import Frame, Rotation
from compas.datastructures import Mesh
from compas_ghpython.artists import MeshArtist
from compas_fab.robots import Tool
from compas_ghpython.utilities import draw_frame

tolerance = 0

if tool == 0:
    filename = 'measurement_tool_zaxis.stl'
    ee_frame = Frame([0, 0, 0.109], [1, 0, 0], [0, 1, 0])

elif tool == 1:
    filename = 'area_gripper_zaxis.stl'
    ee_frame = Frame([0, 0, 0.10219 + tolerance], [0, 1, 0], [-1, 0, 0])

elif tool == 2:
    filename = 'parallel_gripper_small.stl'
    ee_frame = Frame([0, 0, 0.1455 + tolerance], [0, 1, 0], [-1, 0, 0]) 

elif tool == 3:
    filename = 'parallel_gripper_with_mtip.stl'
    ee_frame = Frame([0, 0, 0.20], [0, 1, 0], [-1, 0, 0])

    
data_path = os.path.join(data_path, "tool_geometry")
fullfilename = os.path.join(data_path, filename)
print fullfilename

ee_mesh = Mesh.from_stl(fullfilename)

if show:
    artist = MeshArtist(ee_mesh)
    M = artist.draw()
    ee_plane = draw_frame(ee_frame)

tool = Tool(ee_mesh, ee_frame)

print(ee_frame.quaternion.xyzw)
ee_framek = Frame([0.0110607,0.00809854,0.41498], [0,1,0], [1,0,0])
print(ee_framek.quaternion.xyzw)
# ---------- end tool ----------
panel_15 = Panel("Attach a custom tool")
mesh_2 = Mesh(tool.M)
pln_9 = Plane(tool.ee_plane)
tool_2 = AttachedTool(robot=robot, visual_mesh=mesh_2, collision_mesh=mesh_2, tcf_plane=pln_9, group=list_3)  # -> robot; inputs visual_mesh: Mesh, collision_mesh: Mesh
#   port visual_mesh: A visual mesh for the tool.
#   port collision_mesh: A collision mesh for the tool.
#   port tcf_plane: The frame of the tool in tool0 frame.
#   port group: The planning group to which the tool should be attached.
# ---------- tool_2: Python ----------
"""
Attach a tool to the robot.

COMPAS FAB v0.27.0
"""
from ghpythonlib.componentbase import executingcomponent as component
from compas_rhino.conversions import RhinoMesh
from compas_rhino.conversions import plane_to_compas_frame

from compas.geometry import Frame
from compas_fab.robots import Tool


class AttachToolComponent(component):
    def RunScript(self, robot, visual_mesh, collision_mesh, tcf_plane, group):
        if robot and robot.client and robot.client.is_connected and visual_mesh:
            if not collision_mesh:
                collision_mesh = visual_mesh

            c_visual_mesh = RhinoMesh.from_geometry(visual_mesh).to_compas()
            c_collision_mesh = RhinoMesh.from_geometry(collision_mesh).to_compas()

            if not tcf_plane:
                frame = Frame.worldXY()
            else:
                frame = plane_to_compas_frame(tcf_plane)
            tool = Tool(c_visual_mesh, frame, c_collision_mesh)

            robot.attach_tool(tool, group)
            print tool.link_name

        return robot
# ---------- end tool_2 ----------

list_8 = ValueList({"Load robot locally": 0, "Load robot from ROS": 1}, selected="Load robot from ROS")
filter = StreamFilter(Gate=list_8, Stream0=connect_4.robot, Stream1=tool_2)

robot_2 = Data(filter)

# ----
# Planning scene
scene = PlanningScene(robot=robot_2)  # -> scene
#   port scene: A planning scene.
# ---------- scene: Python ----------
"""
Create a planning scene.

COMPAS FAB v0.27.0
"""
from ghpythonlib.componentbase import executingcomponent as component
from scriptcontext import sticky as st

from compas_fab.ghpython.components import create_id
from compas_fab.robots import PlanningScene


class PlanningSceneComponent(component):
    def RunScript(self, robot):
        key = create_id(self, 'planning_scene')
        if robot:
            st[key] = PlanningScene(robot)
        return st.get(key, None)
# ---------- end scene ----------

attach_remove = PythonScript(robot=robot_2, tool=tool.tool, attach=add, remove=remove)  # -> out, bang
# ---------- attach_remove: Python ----------
if attach:
    robot.attach_tool(tool)
if remove:
    robot.detach_tool()

print tool.link_name
# ---------- end attach_remove ----------

x_axis = Curve(<curve referenced from the Rhino model>)
y_axis = Curve(<curve referenced from the Rhino model>)
plane = PythonScript(plane_axes=[x_axis, y_axis])  # -> plane; inputs plane_axes: list of Curve
# ---------- plane: Python ----------
import Rhino.Geometry as rg

x_axis, y_axis = plane_axes

x_axis = rg.Line(x_axis.PointAtStart, x_axis.PointAtEnd)
y_axis = rg.Line(y_axis.PointAtStart, y_axis.PointAtEnd)

if x_axis.From.DistanceTo(y_axis.From) < 0.01:
    origin = x_axis.From
    xvec = x_axis.Direction
    yvec = y_axis.Direction
elif x_axis.To.DistanceTo(y_axis.To) < 0.01:
    origin = x_axis.To
    xvec = -x_axis.Direction
    yvec = -y_axis.Direction
elif x_axis.From.DistanceTo(y_axis.To) < 0.01:
    origin = x_axis.From
    xvec = x_axis.Direction
    yvec = -y_axis.Direction
elif x_axis.To.DistanceTo(y_axis.From) < 0.01:
    origin = x_axis.To
    xvec = -x_axis.Direction
    yvec = y_axis.Direction

plane = rg.Plane(origin, xvec, yvec)
# ---------- end plane ----------
calc_bcf_wcs = GhPythonScript(robot=robot_2, RCF_WCS_plane=plane)  # -> out, BCF_WCS_plane
# ---------- calc_bcf_wcs: Python ----------
import rhinoscriptsyntax as rs
from compas_rhino.conversions import frame_to_rhino_plane, plane_to_compas_frame
from compas.geometry import Frame, Transformation


RCF_OCS_plane = frame_to_rhino_plane(robot.RCF) # TODO: RCF should move with BCF !!!! NEEDS TO BE CHECKED !!!!

RCF_WCS = plane_to_compas_frame(RCF_WCS_plane)

#print robot.RCF
#print robot.BCF

#Version A

#RCF_RCS = RCF_WCS.transformed(robot.transformation_WCF_RCF())
#BCF_WCS_A = RCF_RCS.transformed(robot.transformation_BCF_WCF())
#
#BCF_WCS_A_plane = frame_to_rhino_plane(BCF_WCS_A)
#BCF_WCS_plane = BCF_WCS_A_plane

#Version B

T2 = Transformation.from_frame_to_frame(robot.RCF, RCF_WCS)
print robot.RCF
BCF_WCS_B = Frame.worldXY().transformed(T2)
BCF_WCS_B_plane = frame_to_rhino_plane(BCF_WCS_B)

BCF_WCS_plane = BCF_WCS_B_plane
# ---------- end calc_bcf_wcs ----------

# ----
# Move mobile robot base
# Picking plane
angle = Slider(203, range=0..360)
base_origin = Point(Point(0.7315701608, -0.8422138913, 0))
x_axis_2 = Curve(<curve referenced from the Rhino model>)
y_axis_2 = Curve(<curve referenced from the Rhino model>)
base_plane = GhPythonScript(origin=base_origin, angle=angle)  # -> base_plane; inputs origin: Point3d
# ---------- base_plane: Python ----------
import Rhino.Geometry as rg
import math

base_plane = rg.Plane(origin, rg.Vector3d.XAxis, rg.Vector3d.YAxis)
base_plane.Rotate(math.radians(angle), rg.Vector3d.ZAxis)
# ---------- end base_plane ----------
set_to_origin = BooleanToggle(False)
plane_2 = PythonScript(plane_axes=[x_axis_2, y_axis_2])  # -> plane; inputs plane_axes: list of Curve
# ---------- plane_2: Python ----------
import Rhino.Geometry as rg

x_axis, y_axis = plane_axes

x_axis = rg.Line(x_axis.PointAtStart, x_axis.PointAtEnd)
y_axis = rg.Line(y_axis.PointAtStart, y_axis.PointAtEnd)

if x_axis.From.DistanceTo(y_axis.From) < 0.01:
    origin = x_axis.From
    xvec = x_axis.Direction
    yvec = y_axis.Direction
elif x_axis.To.DistanceTo(y_axis.To) < 0.01:
    origin = x_axis.To
    xvec = -x_axis.Direction
    yvec = -y_axis.Direction
elif x_axis.From.DistanceTo(y_axis.To) < 0.01:
    origin = x_axis.From
    xvec = x_axis.Direction
    yvec = -y_axis.Direction
elif x_axis.To.DistanceTo(y_axis.From) < 0.01:
    origin = x_axis.To
    xvec = -x_axis.Direction
    yvec = y_axis.Direction

plane = rg.Plane(origin, xvec, yvec)

print(plane)
# ---------- end plane_2 ----------
set_base_frame = PythonScript(robot=robot_2, set_to_origin=set_to_origin, base_plane=bcf_wcs_ab_0)  # -> bang, base_plane
# ---------- set_base_frame: Python ----------
from compas_ghpython import draw_frame
from compas.geometry import Frame, Point, Vector, Transformation
from compas.datastructures import Mesh
from compas_rhino.geometry import RhinoMesh
from compas_fab.robots import CollisionMesh

if set_to_origin:
    base_frame = Frame.worldXY()
else:
    base_frame = Frame(base_plane.Origin, base_plane.XAxis, base_plane.YAxis)


# Base_frame is BCF in WCF
if robot:
    robot.BCF = base_frame
    print(robot.BCF)
# ---------- end set_base_frame ----------
python_9 = GhPythonScript(robot=robot_2, picking_plane=plane_2)
# ---------- python_9: Python ----------
from compas.geometry import Frame

if robot and picking_plane:
    picking_frame = Frame(picking_plane.Origin, picking_plane.XAxis, picking_plane.YAxis)
    robot.PCF = picking_frame
# ---------- end python_9 ----------

# ----
# Attach to scene
panel_16 = Panel("scene_elem")
remove_2 = Button()
add_2 = Button()
mesh_3 = PythonScript(assembly=initial_assembly.assembly, current_key=counter.counter)  # -> elems_compas_meshes, elem_compas_mesh
# ---------- mesh_3: Python ----------
from compas.geometry import Frame, Transformation
from compas.artists import Artist

elems_compas_meshes = []

key_index = assembly.network.key_index()
keys = [key_index[key] for key in assembly.network.nodes()]
elements = [assembly.element(key) for key in keys]

for element in elements[0:current_key+1]:
    m = element.mesh
    elems_compas_meshes.append(m)

elem = assembly.element(0)
T = Transformation.from_change_of_basis(Frame.worldXY(), elem.frame)
mesh_transformed = elem.mesh.transformed(T)
elem_compas_mesh = mesh_transformed
# ---------- end mesh_3 ----------
cm = CollisionMesh(
    scene=scene,
    mesh=mesh_3.elems_compas_meshes,
    identifier=panel_16,
    add=add_2,
    append=set_base_frame.bang,
    remove=remove_2)  # -> ok; inputs mesh: list, add: Boolean, append: Boolean, remove: Boolean
#   port scene: The planning scene.
#   port mesh: A collision mesh.
#   port identifier: The identifier of the collision mesh.
#   port add: If True, adds the collision mesh to the planning scene.
#   port append: If True, appends the collision mesh to the planning scene.
#   port remove: If True, removes the collision mesh from the planning scene.
#   port ok: True if the operation was successfully performed.
# ---------- cm: Python ----------
"""
Add or remove a collision mesh from the planning scene.

COMPAS FAB v0.27.0
"""
from compas_rhino.geometry import RhinoMesh
from ghpythonlib.componentbase import executingcomponent as component

from compas_fab.robots import CollisionMesh


class CollisionMeshComponent(component):
    def RunScript(self, scene, M, name, add, append, remove):
        ok = False
        self.Message = ""
        
        collision_meshes = []
        if (add and append) or (append and remove) or (add and remove):
            self.Message = "Use only one operation at a time\n(add, append or remove)"
            raise Exception(self.Message)

        if scene and M and name:
            for i, elem_mesh in enumerate(M):
                
                #mesh_WCS = RhinoMesh.from_geometry(elem_mesh).to_compas()
                # transform to mobile robot base coordinate system
                id = 'element_' + str(i)
                mesh = elem_mesh.transformed(scene.robot.transformation_WCF_BCF())
                collision_meshes.append(CollisionMesh(mesh, id))
                if add:
                    scene.add_collision_mesh(collision_meshes)
                    self.Message = "Added"
                    ok = True
                if append:
                    scene.append_collision_mesh(collision_meshes)
                    self.Message = "Appended"
                    ok = True
                if remove:
                    scene.remove_collision_mesh(id)
                    self.Message = "Removed"
                    ok = True
        return ok
# ---------- end cm ----------
panel_17 = Panel(cm)

info = PythonScript(robot=robot_2)  # -> out, main_group_name
# ---------- info: Python ----------
if robot:
    robot.info()
    main_group_name = robot.main_group_name
# ---------- end info ----------
panel_18 = Panel(info.out)

# ----
# Attach to robot
panel_19 = Panel("robot_arm_tool0")
remove_3 = Button()
add_3 = Button()
mesh_4 = Mesh(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)
acm = AttachedCollisionMesh(
    scene=scene,
    mesh=mesh_4,
    identifier="rod",
    link_name=panel_19,
    touch_links="robot_arm_tool0",
    add=add_3,
    remove=remove_3)  # -> attached_collision_mesh, bang; inputs mesh: Mesh, touch_links: list, add: Boolean, remove: Boolean
#   port scene: The planning scene.
#   port mesh: A collision mesh.
#   port identifier: The identifier of the collision mesh.
#   port link_name: The robot's link name to attach the mesh to.
#   port touch_links: Names of links that the robot is allowed to touch.
#   port add: If True, adds the collision mesh to the planning scene.
#   port remove: If True, removes the collision mesh from the planning scene.
#   port attached_collision_mesh: A collision mesh that is attached to a robot's link.
# ---------- acm: Python ----------
"""
Add an attached collision mesh to the robot.

COMPAS FAB v0.27.0
"""
from ghpythonlib.componentbase import executingcomponent as component

from compas_rhino.geometry import RhinoMesh
from compas_fab.robots import AttachedCollisionMesh
from compas_fab.robots import CollisionMesh

class AttachedCollisionMeshComponent(component):
    def RunScript(self, scene, mesh, identifier, link_name, touch_links, add, remove):
        attached_collision_mesh = None
        if scene and mesh and identifier and link_name:
            compas_mesh = RhinoMesh.from_geometry(mesh).to_compas()
            collision_mesh = CollisionMesh(compas_mesh, identifier)
            attached_collision_mesh = AttachedCollisionMesh(collision_mesh, link_name, touch_links)
            if add:
                scene.add_attached_collision_mesh(attached_collision_mesh)
            if remove:
                scene.remove_attached_collision_mesh(identifier)
                scene.remove_collision_mesh(identifier)
        return attached_collision_mesh
# ---------- end acm ----------

# ----
# Fabrication Settings
rotation_angle = Slider(-33, range=-180..240)
flip_plane = BooleanToggle(False)
approach_plane_right = Plane(Plane(origin=(-1.36288269, -1.177161348, 1.226122194), x=(0.726005968, -0.6835662975, 0.07518278586), y=(-0.668749938, -0.7272607974, -0.1544838275)))  # disabled
list_9 = ValueList({"left", "right", "top"}, selected="right")
python_10 = GhPythonScript(
    robot=robot_2,
    approach_from=list_9,
    approach_plane_right=approach_plane_right,
    approach_plane_left=approach_plane_left,
    approach_plane_top=pln,
    current_tool_plane=assembly_viz.selected_elem_plane,
    flip_plane=flip_plane,
    rotation_angle=rotation_angle,
    shift_value=shift_value)  # -> out, picking_safe_configuration, approach_configuration, picking_plane_RCF, approach_plane_WCF, picking_plane_safe_RCF, picking_frame_RCF, picking_frame_safe_RCF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
# ---------- python_10: Python ----------
import math
from compas.geometry import Frame, Transformation, Translation
from compas_ghpython import draw_frame
from compas_fab.robots import Configuration
import Rhino.Geometry as rg

offset = 0


if current_tool_plane:
    picking_frame_BCF = robot.PCF
    
    T = Translation.from_vector(picking_frame_BCF.xaxis*shift_value)
    
    picking_frame_BCF_shifted = picking_frame_BCF.transformed(T)
    picking_frame_RCF = picking_frame_BCF_shifted.transformed(robot.transformation_BCF_RCF())
    picking_plane_RCF = draw_frame(picking_frame_RCF)

    picking_plane_safe_RCF = rg.Plane(picking_plane_RCF)
    picking_plane_safe_RCF.Translate(rg.Vector3d.ZAxis*0.3)
    picking_frame_safe_RCF = Frame(picking_plane_safe_RCF.Origin, picking_plane_safe_RCF.XAxis, picking_plane_safe_RCF.YAxis)
    
    # transform picking_frame_RCF and picking_frame_safe_RCF in WCF
    picking_frame_WCF = robot.to_world_coordinates(picking_frame_BCF_shifted)

    picking_frame_safe_BCF = picking_frame_safe_RCF.transformed(robot.transformation_RCF_BCF())
    picking_frame_safe_WCF = robot.to_world_coordinates(picking_frame_safe_BCF)
    
    # visualize picking_frame_WCF and picking_frame_safe_WCF
    picking_plane_WCF = draw_frame(picking_frame_WCF)
    picking_plane_safe_WCF = draw_frame(picking_frame_safe_WCF)
    
    
    placing_plane_WCF = current_tool_plane
    placing_plane_WCF.Translate(placing_plane_WCF.ZAxis*offset)
    #shifting X of Gripper
    placing_plane_WCF.Translate(placing_plane_WCF.XAxis*shift_value)
    placing_plane_WCF.Rotate(math.radians(rotation_angle), placing_plane_WCF.XAxis, placing_plane_WCF.Origin)
    if flip_plane:
        placing_plane_WCF = rg.Plane(placing_plane_WCF.Origin, -placing_plane_WCF.XAxis, placing_plane_WCF.YAxis)
    
    placing_plane_safe_WCF = rg.Plane(placing_plane_WCF)
    placing_plane_safe_WCF.Translate(placing_plane_WCF.ZAxis*-0.2)
    
    #placing_frame_RCF = picking_frame_BCF.transformed(robot.transformation_BCF_RCF())
    
    move_plane_safe_WCF = rg.Plane(placing_plane_WCF)
    move_plane_safe_WCF.Translate(rg.Vector3d.ZAxis*0.30)
    
    
    picking_safe_configuration = Configuration((0.000, -1.777, -1.305, 2.471, -2.736, -1.571, -2.562), (4, 0, 0, 0, 0, 0, 0))
    
    if approach_from == 'left':
        #approach_configuration = 
        approach_plane_WCF = approach_plane_left
        
    if approach_from == 'right':
        approach_configuration = Configuration((0.000, -0.963, -1.592, 2.217, -2.026, -1.542, 1.167), (2, 0, 0, 0, 0, 0, 0))
        approach_plane_WCF = approach_plane_right
    else:
        approach_configuration = Configuration((0.000, -1.034, -1.995, 0.966, -2.162, -1.883, 0.616), (2, 0, 0, 0, 0, 0, 0))
        approach_plane_WCF = approach_plane_top
# ---------- end python_10 ----------
pln_10 = Plane(python_10.picking_plane_WCF)
pln_11 = Plane(python_10.placing_plane_WCF)
pln_12 = Plane(python_10.picking_plane_safe_WCF)
pln_13 = Plane(python_10.placing_plane_safe_WCF)

# ---- group: forward kinematics
a1 = Slider(0, range=-360..360)
a2 = Slider(0, range=-360..360)
a3 = Slider(11, range=-360..360)
a4 = Slider(0, range=-360..360)
a6 = Slider(90, range=-360..360)
a5 = Slider(0, range=-360..360)
jp = GhPythonScript()  # -> joint_positions
# ---------- jp: Python ----------
import math

joint_positions = [0,0,-90,90,0,90,0]
joint_positions = [math.radians(a) for a in joint_positions]
#joint_positions = [-3.136, -0.328, -1.218, 3.129, 0.852, 0.008]
#joint_positions = [0] * 6

#joint_positions =[0.000, 0.518, 0.046, 1.451, -3.088, -1.571, -1.236]


#joint_positions = [1.6239667567485938, 0.25439606475392273, 4.409424838594969-2*3.14, 3.1901607306255908, 1.5707963267948954, 0.053170429953696939]
#joint_positions = [1.598543436748912, 0.23021224965157744, 4.712232135219824-2*3.14, 6.0531299026928744, 4.7123889803846915, 0.027747109954015234]
#joint_positions = [-1.1373533430447322, 4.0117247163121572, 5.4083762087596021-2*3.14, 1.5754733624925168, 4.7123889803846879, 3.5750356373399574]
print joint_positions
# ---------- end jp ----------
forward_kinematics = PythonScript(robot=robot_2, set_joint_positions=Button(), joint_positions=jp, lift=l, a1=a1, a2=a2, a3=a3, a4=a4, a5=a5, a6=a6)  # -> full_configuration; inputs joint_positions: list
# ---------- forward_kinematics: Python ----------
import math
import Grasshopper
from compas.robots import Joint
from compas_fab.robots import Configuration

if set_joint_positions:
    j = 0
    for i in range(ghenv.Component.Params.Input.Count):
        nslider = ghenv.Component.Params.Input[i].Sources[0]
        if nslider.GetType() == Grasshopper.Kernel.Special.GH_NumberSlider:
            nslider.TrySetSliderValue(math.degrees(joint_positions[j]))
            j += 1

if robot:
    joints = robot.get_configurable_joints()
    joint_types = [joint.type for joint in joints]
    joint_names = [joint.name for joint in joints]
    
    joint_positions = [a1, a2, a3, a4, a5, a6]
    joint_positions = [math.radians(position) for position in joint_positions]
    
    if len(joints) == 7:
        joint_positions = [lift] + joint_positions
    
    print joint_types, joint_names, joint_positions
    full_configuration = Configuration(joint_positions, joint_types, joint_names)
    
print(full_configuration)
# ---------- end forward_kinematics ----------

# ---- group: zero configuration
zero_config = ZeroConfig(robot=robot_2)  # -> config
#   port group: If assigned, it will return the zero configuration for the given group, otherwise a full zero configuration.
#   port config: The zero configuration.
# ---------- zero_config: Python ----------
"""
Get a zero configuration for a robot.

COMPAS FAB v0.27.0
"""
from ghpythonlib.componentbase import executingcomponent as component


class ConfigZero(component):
    def RunScript(self, robot, group):

        if robot:
            return robot.zero_configuration(group)

        return None
# ---------- end zero_config ----------

# ---- group: inverse kinematics
list_10 = ValueList({"picking_plane": 0, "picking_plane_safe": 1, "placing_plane_safe": 2, "placing_plane": 3}, selected="placing_plane")
select_configuration = Slider(2, range=0..7)
filter_2 = StreamFilter(Gate=list_10, Stream0=pln_10, Stream1=pln_12, Stream2=pln_13, Stream3=pln_11)
analytic_inverse = PythonScript(robot=robot_2, lift=l, plane_WCS=filter_2, idx=select_configuration, bang=attach_remove.bang)  # -> out, configuration, frame_RCS, frame_BCS, robot_frame; inputs plane_WCS: Plane, idx: Int32, bang: list of Boolean
# ---------- analytic_inverse: Python ----------
import Rhino.Geometry as rg
import math
from compas.geometry import Frame, Transformation, Rotation
from compas_fab.robots import Configuration
from ur_fabrication_control.kinematics.ur_kinematics import inverse_kinematics
from ur_fabrication_control.kinematics.ur_params import ur_params
from compas_ghpython import draw_frame

robot.lift_height = lift

frame_WCS = Frame(plane_WCS.Origin, plane_WCS.XAxis, plane_WCS.YAxis)

# transform frame to robot coordinate system
frame_BCS = frame_WCS.transformed(robot.transformation_WCF_BCF())
frame_RCS = frame_BCS.transformed(robot.transformation_BCF_RCF())

robot_frame = robot.RCF

if robot.attached_tool:
    tool0_RCS = robot.from_tcf_to_t0cf([frame_RCS])[0]
else:
    tool0_RCS = frame_RCS

plane_tool0_RCS = draw_frame(tool0_RCS)
plane_RCS = draw_frame(frame_RCS)

# calculate solutions to frame
ur_params = ur_params["ur10e"] # get the parameters according to the robot model
print ur_params
solutions = inverse_kinematics(tool0_RCS, ur_params)
print solutions

if not len(solutions):
    joint_values = [0, 0, 0, 0, 0, 0]
    configuration = Configuration.from_prismatic_and_revolute_values([0], joint_values)
else:
    joint_values = solutions[idx]
    configuration = [Configuration.from_prismatic_and_revolute_values([lift], joint_values)]

print configuration
# ---------- end analytic_inverse ----------
# ----
x_axis_3 = Curve(<curve referenced from the Rhino model>)
y_axis_3 = Curve(<curve referenced from the Rhino model>)
plane_3 = PythonScript(plane_axes=[x_axis_3, y_axis_3])  # -> plane; inputs plane_axes: list of Curve; same code as plane
ik = InverseKinematics(robot=robot_2, plane=filter_2, start_configuration=forward_kinematics, group=list_6)  # -> configuration
#   port plane: The plane or frame to calculate the inverse kinematic for.
#   port start_configuration: If passed, calculates the inverse such that the joint positions differ the least from the start_configuration. Defaults to the zero configuration.
#   port group: The planning group used for calculation. Defaults to the robot's main planning group.
#   port configuration: The planning group's configuration.
# ---------- ik: Python ----------
"""
Calculate the robot's inverse kinematic for a given plane.

COMPAS FAB v0.27.0
"""
from compas_rhino.conversions import RhinoPlane
from ghpythonlib.componentbase import executingcomponent as component


class InverseKinematics(component):
    def RunScript(self, robot, plane, start_configuration, group):
        configuration = None
        if robot and robot.client and robot.client.is_connected and plane:
            frame = RhinoPlane.from_geometry(plane).to_compas_frame()
            
            frame_BCS = frame.transformed(robot.transformation_WCF_BCF())
            configuration = robot.inverse_kinematics(frame_BCS, start_configuration, group, use_attached_tool_frame=True)
            print configuration
        return configuration
# ---------- end ik ----------

# ---- group: inverse kinematics
select_configuration_2 = Slider(2, range=0..7)
picking_safe_inverse = PythonScript(robot=robot_2, lift=l, plane_WCS=pln_12, idx=select_configuration_2, bang=attach_remove.bang)  # -> out, configuration; inputs plane_WCS: Plane, idx: Int32, bang: list of Boolean; same code as analytic_inverse

# ----
pln_14 = Plane(python_10.approach_plane_WCF)
pln_15 = Plane(python_10.picking_plane_safe_RCF)
pln_16 = Plane(python_10.picking_plane_RCF)

# ----
# Plan 'free' motion
number_slider_4 = Slider(1, range=1..360)
list_11 = ValueList({"ur10e", "ur10e_and_liftkit"}, selected="ur10e")
constraints_from_plane = ConstraintsFromPlane(
    robot=robot_2,
    plane=pln_13,
    group=list_11,
    tolerance_xaxis=Slider(1, range=1..360),
    tolerance_yaxis=number_slider_4,
    tolerance_zaxis=Slider(1, range=1..360))  # -> constraints
#   port plane: The plane or frame from which we create position and orientation constraints.
#   port group: The planning group for which we specify the constraint. Defaults to the robot's main planning group.
#   port tolerance_position: The allowed tolerance to the frame's position (defined in the robot's units). Defaults to 0.001
#   port tolerance_xaxis: The allowed tolerance of the frame's X-axis in degrees.
#   port tolerance_yaxis: The allowed tolerance of the frame's Y-axis in degrees.
#   port tolerance_zaxis: The allowed tolerance of the frame's Z-axis in degrees.
#   port constraints: A list containing a position and an orientation constraint.
# ---------- constraints_from_plane: Python ----------
"""
Create a position and an orientation constraint from a plane calculated for the group's end-effector link.

COMPAS FAB v0.27.0
"""
import math

from compas_rhino.conversions import RhinoPlane
from ghpythonlib.componentbase import executingcomponent as component
from compas_fab.robots import OrientationConstraint


class ConstraintsFromPlane(component):
    def RunScript(self, robot, plane, group, tolerance_position, tolerance_xaxis, tolerance_yaxis, tolerance_zaxis):
        goal_constraints = None
        if robot and plane:
            tolerance_position = tolerance_position or 0.001
            tolerance_xaxis = tolerance_xaxis or 1.
            tolerance_yaxis = tolerance_yaxis or 1.
            tolerance_zaxis = tolerance_zaxis or 1.
            
            frame_WCS = RhinoPlane.from_geometry(plane).to_compas_frame()
            frame_BCS = frame_WCS.transformed(robot.transformation_WCF_BCF())
            
            tolerances_axes = [math.radians(tolerance_xaxis), math.radians(tolerance_yaxis), math.radians(tolerance_zaxis)]
         
            #tolerances_axes = [math.radians(45), 0.01, 0.01]
            goal_constraints = robot.constraints_from_frame(frame_BCS, tolerance_position, tolerances_axes, group)

        return goal_constraints
# ---------- end constraints_from_plane ----------
plan_motion = PlanMotion(
    robot=robot_2,
    goal_constraints=constraints_from_plane,
    start_configuration=picking_safe_inverse.configuration,
    group=list_11,
    compute=Button())  # -> trajectory; inputs goal_constraints: list, attached_collision_meshes: list, path_constraints: list, compute: Boolean
#   port goal_constraints: The goal to be achieved, defined in a set of constraints. Constraints can be very specific, for example defining value domains for each joint, such that the goal configuration is included, or defining a volume in space, to which a specific robot link (e.g. the end-effector) is required to move to.
#   port start_configuration: The robot's full configuration, i.e. values for all configurable joints of the entire robot, at the starting position. Defaults to the all-zero configuration.
#   port group: The planning group used for calculation. Defaults to the robot's main planning group.
#   port attached_collision_meshes: A list of attached collision meshes to be included for planning.
#   port path_constraints: Optional constraints that can be imposed along the solution path. Note that path calculation won't work if the start_configuration violates these constraints. Defaults to None.
#   port planner_id: The name of the algorithm used for path planning. Defaults to 'RRTConnect'
#   port compute: If True, calculates a trajectory.
#   port trajectory: The calculated trajectory.
# ---------- plan_motion: Python ----------
"""
Calculate a motion path.

COMPAS FAB v0.27.0
"""
from ghpythonlib.componentbase import executingcomponent as component
from scriptcontext import sticky as st

from compas_fab.ghpython.components import create_id


class PlanMotion(component):
    def RunScript(self, robot, goal_constraints, start_configuration, group, attached_collision_meshes, path_constraints, planner_id, compute):

        key = create_id(self, 'trajectory')

        path_constraints = list(path_constraints) if path_constraints else None
        attached_collision_meshes = list(attached_collision_meshes) if attached_collision_meshes else None
        planner_id = str(planner_id) if planner_id else 'RRTConnect'

        if robot and robot.client and robot.client.is_connected and start_configuration and goal_constraints and compute:
            st[key] = robot.plan_motion(goal_constraints,
                                        start_configuration=start_configuration,
                                        group=group,
                                        options=dict(
                                            attached_collision_meshes=attached_collision_meshes,
                                            path_constraints=path_constraints,
                                            planner_id=planner_id,
                                        ))

        trajectory = st.get(key, None)
        return trajectory
# ---------- end plan_motion ----------
trajectory_visualize = TrajectoryVisualize(robot=robot_2, group=list_11, trajectory=plan_motion)  # -> start_configuration, configurations, fraction, time, planes, P, V, A
#   port group: The planning group for which this trajectory was planned.
#   port trajectory: The calculated trajectory.
#   port start_configuration: The start configuration of the trajectory.
#   port configurations: The full configurations along the trajectory.
#   port fraction: Indicates the fraction of requested trajectory that was calculated, e.g. 1 means the full trajectory was found.
#   port time: The time which is needed to execute that trajectory at full speed.
#   port planes: The planes of the robot's end-effector.
#   port P: The positions along the trajectory
#   port V: The velocities along the trajectory
#   port A: The accelerations along the trajectory
# ---------- trajectory_visualize: Python ----------
"""
Visualizes a trajectory.

COMPAS FAB v0.27.0
"""
from compas_ghpython import draw_frame
from compas_ghpython import list_to_ghtree
from compas_fab.robots import Configuration
from ghpythonlib.componentbase import executingcomponent as component

class TrajectoryVisualize(component):
    def RunScript(self, robot, group, trajectory):
        start_configuration = None
        configurations = []
        fraction = 0.
        time = 0.

        planes = []
        positions = []
        velocities = []
        accelerations = []

        if robot and trajectory:
            group = group or robot.main_group_name

            for c in trajectory.points:
                config = robot.merge_group_with_full_configuration(c, trajectory.start_configuration, group)
                joint_names_ordered = ['robot_ewellix_lift_top_joint', 'robot_arm_shoulder_pan_joint', 'robot_arm_shoulder_lift_joint', 'robot_arm_elbow_joint', 'robot_arm_wrist_1_joint', 'robot_arm_wrist_2_joint', 'robot_arm_wrist_3_joint']
                joint_values_ordered = [config.joint_values[config.joint_names.index(joint_name)] for joint_name in joint_names_ordered]
                joint_types_ordered = [config.joint_types[config.joint_names.index(joint_name)] for joint_name in joint_names_ordered]
                mobile_robot_config = Configuration(joint_values_ordered, joint_types_ordered, joint_names_ordered)
                configurations.append(mobile_robot_config)
                frame = robot.forward_kinematics(c, group, options=dict(solver='model'))
                
                # transform the planes to mobile robot base
                planes.append(draw_frame(frame.transformed(robot.transformation_BCF_WCF())))
                positions.append(c.positions)
                velocities.append(c.velocities)
                accelerations.append(c.accelerations)

            start_configuration = trajectory.start_configuration
            fraction = trajectory.fraction
            time = trajectory.time_from_start

        P = list_to_ghtree(list(zip(*positions)))
        V = list_to_ghtree(list(zip(*velocities)))
        A = list_to_ghtree(list(zip(*accelerations)))

        # return outputs if you have them; here I try it for you:
        #print configurations
        return (start_configuration, configurations, fraction, time, planes, P, V, A)
# ---------- end trajectory_visualize ----------
python_11 = GhPythonScript(configurations=trajectory_visualize.configurations)  # -> first_configuration, last_configuration, reversed_free_motion_configurations; inputs configurations: list
# ---------- python_11: Python ----------
import rhinoscriptsyntax as rs

if configurations:
    first_configuration = configurations[0]
    last_configuration = configurations[-1]
    reversed_free_motion_configurations = configurations[::-1]
# ---------- end python_11 ----------

# ----
# Plan 'place' cartesian motion
list_12 = ValueList({"ur10e", "ur10e_and_liftkit"}, selected="ur10e")
plan_cartesian_motion = PlanCartesianMotion(robot=robot_2, planes=pln_11, start_configuration=python_11.last_configuration, group=list_12, compute=Button())  # -> trajectory; inputs planes: list, attached_collision_meshes: list, path_constraints: list, compute: Boolean
#   port planes: The planes or frames through which the path is defined.
#   port start_configuration: The robot's full configuration, i.e. values for all configurable joints of the entire robot, at the starting position. Defaults to the all-zero configuration.
#   port group: The planning group used for calculation. Defaults to the robot's main planning group.
#   port attached_collision_meshes: A list of attached collision meshes to be included for planning.
#   port path_constraints: Optional constraints that can be imposed along the solution path. Note that path calculation won't work if the start_configuration violates these constraints. Defaults to None.
#   port max_step: The approximate distance between the calculated points. (Defined in the robot's units.) Defaults to 0.01.
#   port compute: If True, calculates a trajectory.
#   port trajectory: The calculated trajectory.
# ---------- plan_cartesian_motion: Python ----------
"""
Calculate a cartesian motion path (linear in tool space).

COMPAS FAB v0.27.0
"""
from compas_rhino.conversions import RhinoPlane
from ghpythonlib.componentbase import executingcomponent as component
from scriptcontext import sticky as st

from compas_fab.ghpython.components import create_id


class PlanCartesianMotion(component):
    def RunScript(self, robot, planes, start_configuration, group, attached_collision_meshes, path_constraints, max_step, compute):

        key = create_id(self, 'trajectory')

        max_step = float(max_step) if max_step else 0.01
        path_constraints = list(path_constraints) if path_constraints else None
        attached_collision_meshes = list(attached_collision_meshes) if attached_collision_meshes else None

        if robot and robot.client and robot.client.is_connected and start_configuration and planes and compute:
            # transform frame to robot coordinate system
            frames = [RhinoPlane.from_geometry(plane).to_compas_frame().transformed(robot.transformation_WCF_BCF()) for plane in planes]
            st[key] = robot.plan_cartesian_motion(frames,
                                                  start_configuration=start_configuration,
                                                  group=group,
                                                  options=dict(
                                                      max_step=max_step,
                                                      path_constraints=path_constraints,
                                                      attached_collision_meshes=attached_collision_meshes
                                                  ))

        trajectory = st.get(key, None)
        return trajectory
# ---------- end plan_cartesian_motion ----------
trajectory_visualize_2 = TrajectoryVisualize(robot=robot_2, group=list_12, trajectory=plan_cartesian_motion)  # -> start_configuration, configurations, fraction, time, planes, P, V, A
#   port group: The planning group for which this trajectory was planned.
#   port trajectory: The calculated trajectory.
#   port start_configuration: The start configuration of the trajectory.
#   port configurations: The full configurations along the trajectory.
#   port fraction: Indicates the fraction of requested trajectory that was calculated, e.g. 1 means the full trajectory was found.
#   port time: The time which is needed to execute that trajectory at full speed.
#   port planes: The planes of the robot's end-effector.
#   port P: The positions along the trajectory
#   port V: The velocities along the trajectory
#   port A: The accelerations along the trajectory
# ---------- trajectory_visualize_2: Python ----------
"""
Visualizes a trajectory.

COMPAS FAB v0.27.0
"""
from compas_ghpython import draw_frame
from compas_ghpython import list_to_ghtree
from compas_fab.robots import Configuration
from ghpythonlib.componentbase import executingcomponent as component


class TrajectoryVisualize(component):
    def RunScript(self, robot, group, trajectory):
        start_configuration = None
        configurations = []
        fraction = 0.
        time = 0.

        planes = []
        positions = []
        velocities = []
        accelerations = []

        if robot and trajectory:
            group = group or robot.main_group_name

            for c in trajectory.points:
                config = robot.merge_group_with_full_configuration(c, trajectory.start_configuration, group)
                joint_names_ordered = ['robot_ewellix_lift_top_joint', 'robot_arm_shoulder_pan_joint', 'robot_arm_shoulder_lift_joint', 'robot_arm_elbow_joint', 'robot_arm_wrist_1_joint', 'robot_arm_wrist_2_joint', 'robot_arm_wrist_3_joint']
                joint_values_ordered = [config.joint_values[config.joint_names.index(joint_name)] for joint_name in joint_names_ordered]
                joint_types_ordered = [config.joint_types[config.joint_names.index(joint_name)] for joint_name in joint_names_ordered]
                mobile_robot_config = Configuration(joint_values_ordered, joint_types_ordered, joint_names_ordered)
                configurations.append(mobile_robot_config)
                frame = robot.forward_kinematics(c, group, options=dict(solver='model'))
                
                # transform the planes to mobile robot base
                planes.append(draw_frame(frame.transformed(robot.transformation_BCF_WCF())))
                positions.append(c.positions)
                velocities.append(c.velocities)
                accelerations.append(c.accelerations)

            start_configuration = trajectory.start_configuration
            fraction = trajectory.fraction
            time = trajectory.time_from_start

        P = list_to_ghtree(list(zip(*positions)))
        V = list_to_ghtree(list(zip(*velocities)))
        A = list_to_ghtree(list(zip(*accelerations)))

        # return outputs if you have them; here I try it for you:
        return (start_configuration, configurations, fraction, time, planes, P, V, A)
# ---------- end trajectory_visualize_2 ----------
planes = Plane(trajectory_visualize_2.planes)
python_12 = GhPythonScript(configurations=trajectory_visualize.configurations)  # -> first_configuration, last_configuration, reversed_place_configurations; inputs configurations: list
# ---------- python_12: Python ----------
import rhinoscriptsyntax as rs

if configurations:
    first_configuration = configurations[0]
    last_configuration = configurations[-1]
    reversed_place_configurations = configurations[::-1]
# ---------- end python_12 ----------

measured_robot_plane = Plane(set_base_frame.base_plane)
robot_name = Panel("AA")

# ----
# Plan 'pick' cartesian motion
list_13 = ValueList({"ur10e", "ur10e_and_liftkit"}, selected="ur10e")
plan_cartesian_motion_2 = PlanCartesianMotion(robot=robot_2, planes=pln_10, start_configuration=analytic_inverse.configuration, group=list_13, compute=Button())  # -> trajectory; inputs planes: list, attached_collision_meshes: list, path_constraints: list, compute: Boolean
#   port planes: The planes or frames through which the path is defined.
#   port start_configuration: The robot's full configuration, i.e. values for all configurable joints of the entire robot, at the starting position. Defaults to the all-zero configuration.
#   port group: The planning group used for calculation. Defaults to the robot's main planning group.
#   port attached_collision_meshes: A list of attached collision meshes to be included for planning.
#   port path_constraints: Optional constraints that can be imposed along the solution path. Note that path calculation won't work if the start_configuration violates these constraints. Defaults to None.
#   port max_step: The approximate distance between the calculated points. (Defined in the robot's units.) Defaults to 0.01.
#   port compute: If True, calculates a trajectory.
#   port trajectory: The calculated trajectory.
# ---------- plan_cartesian_motion_2: Python ----------
"""
Calculate a cartesian motion path (linear in tool space).

COMPAS FAB v0.27.0
"""
from compas_rhino.conversions import RhinoPlane
from ghpythonlib.componentbase import executingcomponent as component
from scriptcontext import sticky as st

from compas_fab.ghpython.components import create_id


class PlanCartesianMotion(component):
    def RunScript(self, robot, planes, start_configuration, group, attached_collision_meshes, path_constraints, max_step, compute):

        key = create_id(self, 'trajectory')

        max_step = float(max_step) if max_step else 0.01
        path_constraints = list(path_constraints) if path_constraints else None
        attached_collision_meshes = list(attached_collision_meshes) if attached_collision_meshes else None

        if robot and robot.client and robot.client.is_connected and start_configuration and planes and compute:
            # transform frame to robot coordinate system
            frames = [RhinoPlane.from_geometry(plane).to_compas_frame().transformed(robot.transformation_WCF_BCF()) for plane in planes]
                
                
            st[key] = robot.plan_cartesian_motion(frames,
                                                  start_configuration=start_configuration,
                                                  group=group,
                                                  options=dict(
                                                      max_step=max_step,
                                                      path_constraints=path_constraints,
                                                      attached_collision_meshes=attached_collision_meshes
                                                  ))

        trajectory = st.get(key, None)
        return trajectory
# ---------- end plan_cartesian_motion_2 ----------
trajectory_visualize_3 = TrajectoryVisualize(robot=robot_2, group=list_13, trajectory=plan_cartesian_motion_2)  # -> start_configuration, configurations, fraction, time, planes, P, V, A
#   port group: The planning group for which this trajectory was planned.
#   port trajectory: The calculated trajectory.
#   port start_configuration: The start configuration of the trajectory.
#   port configurations: The full configurations along the trajectory.
#   port fraction: Indicates the fraction of requested trajectory that was calculated, e.g. 1 means the full trajectory was found.
#   port time: The time which is needed to execute that trajectory at full speed.
#   port planes: The planes of the robot's end-effector.
#   port P: The positions along the trajectory
#   port V: The velocities along the trajectory
#   port A: The accelerations along the trajectory
# ---------- trajectory_visualize_3: Python ----------
"""
Visualizes a trajectory.

COMPAS FAB v0.27.0
"""
from compas_ghpython import draw_frame
from compas_ghpython import list_to_ghtree
from compas_fab.robots import Configuration
from ghpythonlib.componentbase import executingcomponent as component


class TrajectoryVisualize(component):
    def RunScript(self, robot, group, trajectory):
        start_configuration = None
        configurations = []
        fraction = 0.
        time = 0.

        planes = []
        positions = []
        velocities = []
        accelerations = []

        if robot and trajectory:
            group = group or robot.main_group_name

            for c in trajectory.points:
                config = robot.merge_group_with_full_configuration(c, trajectory.start_configuration, group)
                joint_names_ordered = ['robot_ewellix_lift_top_joint', 'robot_arm_shoulder_pan_joint', 'robot_arm_shoulder_lift_joint', 'robot_arm_elbow_joint', 'robot_arm_wrist_1_joint', 'robot_arm_wrist_2_joint', 'robot_arm_wrist_3_joint']
                joint_values_ordered = [config.joint_values[config.joint_names.index(joint_name)] for joint_name in joint_names_ordered]
                joint_types_ordered = [config.joint_types[config.joint_names.index(joint_name)] for joint_name in joint_names_ordered]
                mobile_robot_config = Configuration(joint_values_ordered, joint_types_ordered, joint_names_ordered)
                configurations.append(mobile_robot_config)
                frame = robot.forward_kinematics(c, group, options=dict(solver='model'))
                
                # transform the planes to mobile robot base
                planes.append(draw_frame(frame.transformed(robot.transformation_BCF_WCF())))
                
                
                positions.append(c.positions)
                velocities.append(c.velocities)
                accelerations.append(c.accelerations)

            start_configuration = trajectory.start_configuration
            fraction = trajectory.fraction
            time = trajectory.time_from_start

        P = list_to_ghtree(list(zip(*positions)))
        V = list_to_ghtree(list(zip(*velocities)))
        A = list_to_ghtree(list(zip(*accelerations)))

        # return outputs if you have them; here I try it for you:
        return (start_configuration, configurations, fraction, time, planes, P, V, A)
# ---------- end trajectory_visualize_3 ----------
python_13 = GhPythonScript(configurations=trajectory_visualize_3.configurations)  # -> first_configuration, last_configuration, reversed_pick_configurations; inputs configurations: list
# ---------- python_13: Python ----------
import rhinoscriptsyntax as rs

if configurations:
    last_configuration = configurations[-1]
    first_configuration = configurations[0]
    reversed_pick_configurations = configurations[::-1]
# ---------- end python_13 ----------

bang_2 = GhPythonScript(x=[acm.bang, cm])  # -> out, flatten(x); inputs x: list
# ---------- bang_2: Python ----------
print x
# ---------- end bang_2 ----------

# ----
# Update "robot AA" frame
# to Realtime Database
connect_6 = BooleanToggle(False)
update = Button()
upload = PythonScript(
    path=data,
    current_index=read.current_index,
    robot_name=robot_name,
    measured_robot_plane=measured_robot_plane,
    update_robot_base_plane=update,
    connect=connect_6)  # inputs current_index: Int32, connect: Boolean
# ---------- upload: Python ----------
import os
import compas
from compas.rpc import Proxy
from compas_rhino.conversions import plane_to_compas_frame

if robot_name =="AA":
    robot_frame = "robot_AA_base_frame"
elif robot_name == "AB":
    robot_frame = "robot_AB_base_frame"

if connect:
    p = Proxy(package = 'cdf_2023.firebase.realtime_database', path=path +'\src')
    p.stop_server()
    p.start_server()

if update_robot_base_plane and measured_robot_plane and current_index != None:
    measured_robot_frame = plane_to_compas_frame(measured_robot_plane)
    p.update_robot_frame(current_index,robot_name, robot_frame, measured_robot_frame.to_data())
# ---------- end upload ----------

planes_2 = Plane(trajectory_visualize_3.planes)

# ----
# Select
# Config
configuration = Slider(73, range=0..100)
item = ListItem(List=trajectory_visualize_3.configurations, Index=configuration, Wrap=True)

# ----
# Select
# Config
configuration_2 = Slider(4, range=0..100)
item_2 = ListItem(List=trajectory_visualize_2.configurations, Index=configuration_2, Wrap=True)

python_14 = PythonScript(trajectory=trajectory_visualize.configurations)  # -> trajectory; inputs trajectory: list
# ---------- python_14: Python ----------
trajectory = trajectory
# ---------- end python_14 ----------
planes_3 = Plane(trajectory_visualize.planes)
counter_4 = CountThroughList(L=python_14, start=start_3, stop=stop_4, step=step_2, back=back_2, reset=reset_4, interval=1)  # -> item; inputs L: list, start: Boolean, stop: Boolean
# ---------- counter_4: Python ----------
from scriptcontext import sticky as st
from compas_ghpython.utilities import update_component

if not interval:
    interval = 10

# store data in component
guid = str(ghenv.Component.InstanceGuid)
counter_key = "counter_" + guid
running_key = "running_" + guid

#st.clear()
if reset:
    st[counter_key] = 0
    
if counter_key not in st:
    st[counter_key] = 0

if running_key not in st:
    st[running_key] = False

if start:
    st[running_key] = True

if stop:
    st[running_key] = False

if step:
    if st[counter_key] < len(L) - 1:
        st[counter_key] += 1

if back:
    if st[counter_key] > 1:
        st[counter_key] -= 1

if len(L):
    item = L[st[counter_key]]

if st[running_key]:
    if st[counter_key] < len(L) - 1:
        st[counter_key] += 1
        update_component(ghenv, interval)
    else:
        st[counter_key] = 0
        st[running_key] = False
# ---------- end counter_4 ----------

list_14 = ValueList({"0 zero_configuration": 0, "1 forward_kinematics": 1, "2 inverse_kinematics analytical": 2, "3 inverse_kinematics MoveIt": 3, "4 motion_planning": 4, "5 cartesian_motion_planning": 5, "6 'pick_and_place'": 6, "7 from json": 7}, selected="2 inverse_kinematics analytical")
filter_3 = StreamFilter(
    Gate=list_14,
    Stream0=zero_config,
    Stream1=forward_kinematics,
    Stream2=analytic_inverse.configuration,
    Stream3=ik,
    Stream4=python_11.last_configuration,
    Stream5=item,
    Stream6=counter_4,
    Stream7=counter_3)

# ----
# Visualisation
show_end_effector_frame = BooleanToggle(False)
show_base_frame = BooleanToggle(True)
show_collision = BooleanToggle(False)
show_frames = BooleanToggle(False)
show_visual = BooleanToggle(True)
show_reach = BooleanToggle(False)
show_acm = BooleanToggle(True)
show_cm = BooleanToggle(True)
robot_visualize = RobotVisualize(
    robot=robot_2,
    group=list_6,
    configuration=filter_3,
    show_visual=show_visual,
    show_collision=show_collision,
    show_frames=show_frames,
    show_base_frame=show_base_frame,
    show_robot_frame=show_robot_frame,
    show_end_effector_frame=show_end_effector_frame,
    show_reach=show_reach,
    show_cm=show_cm,
    show_acm=show_acm,
    redraw=bang_2.x)  # -> visual, collision, collision_meshes, attached_meshes, all_frames, base_frame, robot_frame, ee_frame, reach; inputs show_visual: Boolean, show_collision: Boolean, show_frames: Boolean, show_base_frame: Boolean, show_end_effector_frame: Boolean, show_cm: Boolean, show_acm: Boolean, redraw: list
#   port group: The planning group used for end-effector and base visualization.
#   port configuration: The robot's full configuration.
#   port show_visual: Whether or not to show the robot's visual meshes.
#   port show_collision: Whether or not to show the robot's collision meshes.
#   port show_frames: Whether or not to show the robot's joint frames.
#   port show_base_frame: Whether or not to show the robot's base frame.
#   port show_end_effector_frame: Whether or not to show the robot's end-effector frame.
#   port show_cm: Whether or not to show the collision meshes (if any).
#   port show_acm: Whether or not to show the attached collision meshes (if any).
#   port visual: Rhino meshes of the robot's visual geometry (if any).
#   port collision: Rhino meshes of the robot's collision geometry (if any).
#   port collision_meshes: Rhino meshes of the scene's collision meshes (if any).
#   port attached_meshes: Rhino meshes of the scene's attached collision meshes (if any).
#   port all_frames: The robot's joint frames as Rhino planes (if any).
#   port base_frame: The robot's base frame as a Rhino plane (if any).
#   port ee_frame: The robot's end-effector frame as a Rhino plane (if any).
# ---------- robot_visualize: Python ----------
"""
Visualizes the robot.

COMPAS FAB v0.27.0
"""
import Rhino.Geometry as rg
import ghpythonlib.components as ghcomp
from compas.artists import Artist
from compas.geometry import Frame
from compas.geometry import Transformation
from compas_fab.robots import PlanningScene
from compas_ghpython.utilities import draw_frame
from ghpythonlib.componentbase import executingcomponent as component

class RobotVisualize(component):
    def RunScript(
        self,
        robot,
        group,
        configuration,
        show_visual,
        show_collision,
        show_frames,
        show_base_frame,
        show_robot_frame,
        show_end_effector_frame,
        show_reach,
        show_cm,
        show_acm,
        redraw
    ):

        visual = None
        collision = None
        collision_meshes = None
        attached_meshes = None
        frames = None
        base_frame = None
        robot_frame = None
        ee_frame = None
        all_frames = None
        reach = None

        if robot:
            show_visual = True if show_visual is None else show_visual
            show_cm = True if show_cm is None else show_cm
            show_acm = True if show_acm is None else show_acm
            configuration = configuration or robot.zero_configuration()

            robot.update(configuration, visual=show_visual, collision=show_collision)
            frames = robot.transformed_frames(configuration, group)

            if show_visual:
                visual = robot.artist.draw_visual()
                # orient the robot to its base plane:
                robot_BCF = draw_frame(robot.BCF) 
                init_robot_plane = rg.Plane.WorldXY
                visual = ghcomp.Orient(visual, init_robot_plane, robot_BCF)[0]

            if show_collision:
                collision = robot.artist.draw_collision()

            if show_base_frame:
                base_frame = robot.BCF

            if show_robot_frame:
                robot_frame = robot.RCF
                #robot_frame = robot.to_world_coordinates(robot_frame)
                
            if show_end_effector_frame:
                ee_frame = robot.forward_kinematics(
                    configuration, group, options=dict(solver="model")
                )

            if show_frames:
                all_frames = [robot.to_world_coordinates(frame) for frame in frames]
                
            if show_reach:
                ur_base_plane = draw_frame(robot.RCF)
                reach = rg.Sphere(ur_base_plane, 1.25 + robot.attached_tool.frame.point.z)

            if show_cm or show_acm:
                scene = PlanningScene(robot)
                scene = robot.client.get_planning_scene()

                collision_meshes = []
                attached_meshes = []

                if show_cm:
                    for co in scene.world.collision_objects:
                        header = co.header
                        frame_id = header.frame_id
                        cms = co.to_collision_meshes()

                        for cm in cms:
                            if cm.frame != Frame.worldXY():
                                t = Transformation.from_frame(cm.frame)
                                mesh = cm.mesh.transformed(t)
                            else:
                                mesh = cm.mesh
                            
                            mesh_t = mesh.transformed(robot.transformation_BCF_WCF())
                            collision_meshes.append(Artist(mesh_t).draw())

                if show_acm:
                    for aco in scene.robot_state.attached_collision_objects:
                        for acm in aco.to_attached_collision_meshes():
                            frame_id = aco.object["header"]["frame_id"]
                            frame = robot.forward_kinematics(
                                configuration, options=dict(link=frame_id)
                            )
                            t = Transformation.from_frame(frame)

                            # Local CM frame
                            if (
                                acm.collision_mesh.frame
                                and acm.collision_mesh.frame != Frame.worldXY()
                            ):
                                t = t * Transformation.from_frame(
                                    acm.collision_mesh.frame
                                )

                            mesh = acm.collision_mesh.mesh.transformed(t)
                            # transform to mobile robot base
                            mesh_t = mesh.transformed(robot.transformation_BCF_WCF())

                            attached_meshes.append(Artist(mesh_t).draw())

        return (
            visual,
            collision,
            collision_meshes,
            attached_meshes,
            all_frames,
            base_frame,
            robot_frame,
            ee_frame,
            reach
        )
# ---------- end robot_visualize ----------
geo_5 = Geometry(robot_visualize.reach)
geo_6 = Geometry(robot_visualize.visual)
geo_7 = Geometry(robot_visualize.collision)
geo_8 = Geometry(robot_visualize.collision_meshes)
geo_9 = Geometry(robot_visualize.attached_meshes)
draw = GhPythonScript(
    frames=[robot_visualize.robot_frame, robot_visualize.all_frames, robot_visualize.ee_frame],
    scale=Slider(0.2, range=0..1))  # -> P, V, C, W; inputs frames: list
# ---------- draw: Python ----------
from System.Drawing import Color
from compas_ghpython.utilities import draw_frame

red = Color.FromArgb(255, 0, 0)
green = Color.FromArgb(0, 255, 0)
blue = Color.FromArgb(0, 0, 255)

P = []
V = []
C = []

scale = float(scale)

for frame in frames:
    if not frame:
        continue
    plane = draw_frame(frame)
    P += [plane.Origin] * 3
    V.append(plane.XAxis * scale)
    V.append(plane.YAxis * scale)
    V.append(plane.ZAxis * scale)
    C += [red, green, blue]

W = 3
# ---------- end draw ----------
preview_8 = CustomPreview(Geometry=geo_5, Shader=ColourSwatch(SwatchColor=RGBA(255, 212, 212, 97)))
preview_9 = CustomPreview(Geometry=geo_6, Shader=ColourSwatch(SwatchColor=RGB(105, 105, 105)))
preview_10 = CustomPreview(Geometry=[geo_8, geo_9, geo_7], Shader=ColourSwatch(SwatchColor=RGB(255, 255, 255)))
vdisex = VectorDisplayEx(Point=draw.P, Vector=draw.V, Colour=draw.C, Width=draw.W)

# ----
# Select
# Config
configuration_3 = Slider(23, range=0..100)
item_3 = ListItem(List=trajectory_visualize.configurations, Index=configuration_3, Wrap=True)

python_15 = PythonScript(assembly=initial_assembly.assembly, key=counter.counter, trajectory=trajectory_visualize.configurations)  # -> assembly, planned_trajectory; inputs key: Int32, trajectory: list
# ---------- python_15: Python ----------
from compas.robots import Configuration

if trajectory:
    element = assembly.element(key)
    element.trajectory = [configuration for configuration in trajectory]
    assembly.network.node_attribute(key, 'is_planned', True)
# ---------- end python_15 ----------

# ----
# Export .json
export_4 = Button()
export_5 = Button()
export_6 = PythonScript(DATA=py_3.DATA, assembly=python_15.assembly, export_to_json=export_4, export_to_json_unity=export_5)
# ---------- export_6: Python ----------
import os
from compas.datastructures.mesh import mesh_quads_to_triangles
from compas.datastructures.mesh import mesh_unify_cycles

if export_to_json:
    filename = "assembly_example_02_230726.json"
    PATH = os.path.join(DATA, "assembly", filename)
    
    # the assembly has to be serialized such that it can be called from CPython, True to enable pretty print
    assembly.to_json(PATH, True)
    

if export_to_json_unity:
    
    for key, e in assembly.elements():
    
        #convert to trimesh
        mesh_quads_to_triangles(e._mesh, check_angles=False)
        #mesh_unify_cycles(e._mesh)
        #print e._mesh.faces
        #print e._mesh.face_vertices(list(e._mesh.faces())[0])

    filename = "unity_assembly_test.json"
    PATH = os.path.join(DATA, "assembly", filename)
    assembly.to_json(PATH)
# ---------- end export_6 ----------

# ----
# Move Joints
list_15 = ValueList({"send one configuration": 0, "send multiple configuration": 1}, selected="send one configuration")
radius = Slider(0.001, range=0..0.5)
filter_4 = StreamFilter(Gate=list_15, Stream0=filter_3, Stream1=trajectory_visualize.configurations)
move_joint = PythonScript(configurations=filter_4, velocity=Slider(0.1, range=0..0.5), radius=radius)  # -> urscript, lift, values; inputs configurations: list
# ---------- move_joint: Python ----------
from ur_fabrication_control.direct_control import URScript
from compas_fab.robots import Configuration
import math

urscript = URScript()
urscript.start()
for configuration in configurations:
    joint_configuration = Configuration.from_revolute_values(configuration.revolute_values)
    #lift = configuration
    urscript.move_joint(joint_configuration, velocity, radius)
    #urscript.move_joint(configuration, velocity)
urscript.end()

urscript = urscript.generate()

print(urscript)
# ---------- end move_joint ----------
send_3 = Button()
ur_send = GhPythonScript(urscript=move_joint.urscript, send=send_3)  # -> out; inputs send: Boolean
# ---------- ur_send: Python ----------
from scriptcontext import sticky as st
from ur_fabrication_control.direct_control import send_script

ur_ip = st["ur_ip"]
ur_port = st["ur_port"]

print urscript

if send:
    send_script(urscript, ur_ip, ur_port)
# ---------- end ur_send ----------

# ----
# Move Cartesian
list_16 = ValueList({"send one cartesian position": 0, "send all cartesian positions": 1}, selected="send all cartesian positions")
radius_2 = Slider(0, range=0..0.5)
filter_5 = StreamFilter(Gate=list_16, Stream1=python_10.picking_frame_RCF)
movel_linear = PythonScript(robot=robot_2, frames_RCS=filter_5, velocity=Slider(0.044, range=0..0.5), radius=radius_2)  # -> urscript; inputs frames_RCS: list
# ---------- movel_linear: Python ----------
import Rhino.Geometry as rg
from compas.geometry import Frame
from compas.geometry import Transformation, Rotation
from compas_ghpython import draw_frame
from ur_fabrication_control import direct_control 
import math

from scriptcontext import sticky as st
from ur_fabrication_control.direct_control import URScript

# retrieve the current tool frame in axis angle format
if robot.attached_tool:
    tool_angle_axis = list(robot.attached_tool.frame.point) + list(robot.attached_tool.frame.axis_angle_vector)
else:
    tool0_frame = Frame([0, 0, 0], [1, 0, 0], [0, 1, 0])
    tool_angle_axis = list(tool0_frame.point) + list(tool0_frame.axis_angle_vector)


urscript = URScript()
urscript.start()
urscript.set_tcp(tool_angle_axis)
for frame_RCS in frames_RCS:
    urscript.move_linear(frame_RCS, velocity, radius)
urscript.end()

urscript = urscript.generate()

print(urscript)
# ---------- end movel_linear ----------
send_4 = Button()
ur_send_2 = GhPythonScript(urscript=movel_linear, send=send_4)  # -> out; inputs send: Boolean
# ---------- ur_send_2: Python ----------
from scriptcontext import sticky as st
from ur_fabrication_control.direct_control import send_script

ur_ip = st["ur_ip"]
ur_port = st["ur_port"]

if send:
    send_script(urscript, ur_ip, ur_port)
# ---------- end ur_send_2 ----------

# ----
# Generate 'pick and place' commands
send_5 = Button()
list_17 = ValueList({"1. 'pick and place'": 0, "2. 'release and move to pick up safe'": 1, "3. 'move to pick up safe'": 2, "4. 'move to pick up'": 3, "5. 'move to place safe'": 4, "6. 'move to place'": 5}, selected="1. 'pick and place'")
radius_3 = Slider(0.025, range=0..0.1)
configurations = Data(trajectory_visualize_3.configurations)
configurations_2 = Data(trajectory_visualize.configurations)
configurations_3 = Data(trajectory_visualize_2.configurations)
generate_ur_script = PythonScript(
    robot=robot_2,
    picking_configuration=picking_safe_inverse.configuration,
    pick_cartesian_configs=configurations,
    free_motion_configs=configurations_2,
    place_cartesian_configs=configurations_3,
    picking_frame_RCF=python_10.picking_frame_RCF,
    picking_frame_safe_RCF=python_10.picking_frame_safe_RCF,
    placing_plane_safe=pln_13,
    placing_plane=pln_11,
    routine=list_17,
    velocity=Slider(0.067, range=0..0.35),
    radius=radius_3)  # -> out, placing_frame_safe_RCF, urscript; inputs pick_cartesian_configs: list, free_motion_configs: list, place_cartesian_configs: list, routine: Int32
# ---------- generate_ur_script: Python ----------
from ur_fabrication_control.direct_control import URScript
from ur_fabrication_control.direct_control.mixins import ParallelGripMixins
from compas_fab.robots import Configuration

import math
from scriptcontext import sticky as st
import Rhino.Geometry as rg

from compas.geometry import Frame, Transformation


class URScript_CDF(URScript, ParallelGripMixins):
    pass

tool_angle_axis = list(robot.attached_tool.frame.point) + list(robot.attached_tool.frame.axis_angle_vector)
sleep = 1.0



def plane_to_frame_RCF(plane_WCS):
    frame_WCS = Frame(plane_WCS.Origin, plane_WCS.XAxis, plane_WCS.YAxis)
    frame_BCS = frame_WCS.transformed(robot.transformation_WCF_BCF())
    frame_RCS = frame_BCS.transformed(robot.transformation_BCF_RCF())
    return frame_RCS

placing_frame_RCF = plane_to_frame_RCF(placing_plane) 
placing_frame_safe_RCF = plane_to_frame_RCF(placing_plane_safe)
    
#traj_frames = []
#for plane in traj_planes_WCF:
#    traj_frames.append(plane_to_frame(plane))

reversed_free_motion_configs = free_motion_configs[::-1]
reversed_place_cartesian_configs = place_cartesian_configs[::-1]
reversed_pick_cartesian_configs = pick_cartesian_configs[::-1]

picking_configuration = Configuration.from_revolute_values(picking_configuration.revolute_values)


# pick and place
if routine == 0:
    commands = URScript_CDF()
    commands.start()
    #commands.set_payload(1.4)
    commands.set_tcp(tool_angle_axis)
    commands.move_joint(picking_configuration, velocity) 
    commands.parallelgrip_open() 
    
    commands.move_linear(picking_frame_RCF, velocity, radius=0)
    
    commands.add_line("\tsleep({})".format(sleep))
    commands.parallelgrip_close() 
    commands.add_line("\tsleep({})".format(sleep))
    #commands.set_payload(1.5)
    
    commands.move_linear(picking_frame_safe_RCF, velocity, radius=0)

    for configuration in free_motion_configs:
        joint_configuration = Configuration.from_revolute_values(configuration.revolute_values)
        commands.move_joint(joint_configuration, velocity, radius)
    
    commands.move_linear(placing_frame_RCF, velocity, radius=0)
    
    commands.end()  

# release and move to home
if routine == 1:
    commands = URScript_CDF()
    commands.start()
    commands.set_payload(1.5)
    commands.set_tcp(tool_angle_axis)
    commands.parallelgrip_open() 
    commands.set_payload(1.4)

    commands.move_linear(placing_frame_safe_RCF, velocity, radius=0)

    for configuration in reversed_free_motion_configs:
        joint_configuration = Configuration.from_revolute_values(configuration.revolute_values)
        commands.move_joint(joint_configuration, velocity, radius)
        
    commands.move_joint(picking_configuration, velocity)
    commands.end() 
    
# move to picking_frame_safe
if routine == 2:
    commands = URScript_CDF()
    commands.start()
    commands.set_tcp(tool_angle_axis)
    commands.move_linear(picking_frame_safe_RCF, velocity, radius=0)
    commands.end() 

# move to picking_frame
if routine == 3:
    commands = URScript_CDF()
    commands.start()
    commands.set_tcp(tool_angle_axis)
    commands.move_linear(picking_frame_RCF, velocity, radius=0)
    commands.end()    
    
# move to placing_frame_safe
if routine == 4:
    commands = URScript_CDF()
    commands.start()
    commands.set_tcp(tool_angle_axis)
    commands.move_linear(placing_frame_safe_RCF, velocity, radius=0)
    commands.end() 

# move to placing_frame
if routine == 5:
    commands = URScript_CDF()
    commands.start()
    commands.set_tcp(tool_angle_axis)
    commands.move_linear(placing_frame_RCF, velocity, radius=0)
    commands.end()  
    
  
    



urscript = commands.generate()

print(urscript)
# ---------- end generate_ur_script ----------
send_6 = GhPythonScript(urscript=generate_ur_script.urscript, send=send_5)  # -> out; inputs send: Boolean
# ---------- send_6: Python ----------
from scriptcontext import sticky as st
from ur_fabrication_control.direct_control import send_script

ur_ip = st["ur_ip"]
ur_port = st["ur_port"]

print urscript
if send:
    send_script(urscript, ur_ip, ur_port)
# ---------- end send_6 ----------

# ----
# Get Pose Joint
get_3 = Button()
pose = PythonScript(robot=robot_2, get=get_3)  # -> out, configuration, pose_joints
# ---------- pose: Python ----------
from scriptcontext import sticky as st
from ur_fabrication_control.direct_control.common import get_current_pose_joints
from compas_fab.robots import Configuration


robot = st["robot"]

server_ip= st["server_ip"]
server_port = st["server_port"]
ur_port = st["ur_port"]
ur_ip = st["ur_ip"]
print ur_ip

guid = str(ghenv.Component.InstanceGuid)
pose_joints_key = "pose_joints" + guid

# retrieve the current tool frame in axis angle format
if robot.attached_tool:
    tool_angle_axis = list(robot.attached_tool.frame.point) + list(robot.attached_tool.frame.axis_angle_vector)
else:
    tool0_frame = Frame([0, 0, 0], [1, 0, 0], [0, 1, 0])
    tool_angle_axis = list(tool0_frame.point) + list(tool0_frame.axis_angle_vector)

print(tool_angle_axis)

# send script to the robot to receive the current joint configuration
if get:
    st[pose_joints_key] = get_current_pose_joints(server_ip, server_port, ur_ip, ur_port, tool_angle_axis)

print(st[pose_joints_key])
configuration = Configuration.from_revolute_values(st[pose_joints_key])
pose_joints = configuration.joint_values
"""
if pose_joints_key not in st:
    configuration = Configuration.from_revolute_values([0,0,0,0,0,0])
else:
    configuration = Configuration.from_revolute_values(st[pose_joints_key])

pose_joints = configuration.values
"""
# ---------- end pose ----------
panel_20 = Panel(pose.pose_joints)

# ----
# Calculate BCF from measured RCF in WCS
calc_bcf_wcs_2 = GhPythonScript(robot=robot_2, RCF_WCS_plane=rcf_wcs_aa_0_corr3)  # -> out, RCF_OCS_plane, BCF_WCS_plane; same code as calc_bcf_wcs
pln_17 = Plane(calc_bcf_wcs_2.RCF_OCS_plane)

pln_18 = Plane(calc_bcf_wcs_2.BCF_WCS_plane)

# ----
# Get Pose Cartesian
get_4 = Button()
pose_2 = PythonScript(robot=robot_2, get=get_4)  # -> out, pose_cartesian
# ---------- pose_2: Python ----------
from scriptcontext import sticky as st
#from ur_fabrication_control.online_control.ur_direct import get_current_pose_cartesian

from ur_fabrication_control.direct_control.common import get_current_pose_cartesian
from compas.geometry import Frame
from compas_ghpython import draw_frame


server_ip = st["server_ip"]
server_port = st["server_port"]
ur_port = st["ur_port"]
ur_ip = st["ur_ip"]
pose_cartesian_meter = []
print ur_ip

# retrieve the current tool frame in axis angle format
if robot.attached_tool:
    print ("attached")
    tool_angle_axis = list(robot.attached_tool.frame.point) + list(robot.attached_tool.frame.axis_angle_vector)
    
else:
    tool0_frame = Frame([0, 0, 0], [1, 0, 0], [0, 1, 0])
    tool_angle_axis = list(tool0_frame.point) + list(tool0_frame.axis_angle_vector)

print(tool_angle_axis)

guid = str(ghenv.Component.InstanceGuid)
pose_cartesian_key = "pose_cartesian" + guid


if get:
    print ("getting pose")
    st[pose_cartesian_key] = get_current_pose_cartesian(tool_angle_axis, server_ip, server_port, ur_ip, ur_port, send=True)
#    st[pose_cartesian_key] = get_current_pose_cartesian(server_ip, server_port, ur_ip, tool_angle_axis)
    

if pose_cartesian_key not in st:
    pose_cartesian_mm = []
    pose_cartesian_meter = []
else:
    pose_cartesian = st[pose_cartesian_key]
# ---------- end pose_2 ----------

# ----
# Calculate Basis - 3-Point Method
# Measure basis:
# 1. Clear the recorded poses
# 2. Move robot to origin and press "get pose"
# 3. Move robot to point in positive x-axis and press "get pose"
# 4. Move robot to an other point in your basis and press "get pose"
# (The further away these positions are, the better)
# 
# 5. Alternatively change the order in the component calc base
# 6. Copy output into base component (TODO: check if it has to be inverted)
list_18 = ValueList({"o, pos.x-axis, xy pl": 0, "o, pos.y-axis, xy pl": 1}, selected="o, pos.x-axis, xy pl")
clear = Button()
rec = PythonScript(msg=pose_2.pose_cartesian, rec=get_4, clear=clear)  # -> rec; inputs msg: list
# ---------- rec: Python ----------
from scriptcontext import sticky as st

guid = str(ghenv.Component.InstanceGuid)
recorded_key =  "recorded_" + guid
just_cleared_key = "just_cleared_" + guid


if recorded_key not in st:
    st[recorded_key] = []

if just_cleared_key not in st:
    st[just_cleared_key] = False

if clear:
    st[recorded_key] = []
    st[just_cleared_key] = True
else:
    if len(msg):
        if msg != [None] and not st[just_cleared_key] and rec:
            st[recorded_key].append(msg)
    st[just_cleared_key] = False
        


rec = st[recorded_key]

print rec
# ---------- end rec ----------
calc_robot_plane = PythonScript(poses=rec, input_type=list_18)  # -> out, robot_plane, base_plane; inputs poses: list
# ---------- calc_robot_plane: Python ----------
import Rhino.Geometry as rg
import math


if len(poses) > 2:
    
    O = poses[0]
    P1 = poses[1]
    P2 = poses[2]
    
    if input_type == 0:
        # origin, pt on positive x-axis, pt in xy plane
        origin = rg.Point3d(O[0], O[1], O[2])
        pt_on_xaxis = rg.Point3d(P1[0], P1[1], P1[2])
        pt_in_xyplane = rg.Point3d(P2[0], P2[1], P2[2])
        
        xaxis = pt_on_xaxis - origin
        xaxis.Unitize()
        
        v = pt_in_xyplane - origin
        zaxis = rg.Vector3d.CrossProduct(v, xaxis)
        zaxis.Unitize()
        
        # zaxis must look up!
        if math.acos(rg.Vector3d.ZAxis * zaxis) > math.acos(rg.Vector3d.ZAxis * -zaxis):
            zaxis = -zaxis
        
        yaxis = rg.Vector3d.CrossProduct(zaxis, xaxis)
    
    elif input_type == 1:
        # origin, pt on positive y-axis, pt in xy plane
        origin = rg.Point3d(O[0], O[1], O[2])
        pt_on_yaxis = rg.Point3d(P1[0], P1[1], P1[2])
        pt_in_xyplane = rg.Point3d(P2[0], P2[1], P2[2])
        
        yaxis = pt_on_yaxis - origin
        yaxis.Unitize()
        
        v = pt_in_xyplane - origin
        zaxis = rg.Vector3d.CrossProduct(v, yaxis)
        zaxis.Unitize()
        
        # zaxis must look up!
        if math.acos(rg.Vector3d.ZAxis * zaxis) > math.acos(rg.Vector3d.ZAxis * -zaxis):
            zaxis = -zaxis
        
        xaxis = rg.Vector3d.CrossProduct(yaxis, zaxis)
        
        
    print "Copy the following into base component:"
    print " "
    print "origin = [%.2f, %.2f, %.2f]" % tuple(list(origin))
    print "xaxis = [%.5f, %.5f, %.5f]" % tuple(list(xaxis))
    print "yaxis = [%.5f, %.5f, %.5f]" % tuple(list(yaxis))
    

#print rg.Vector3d.CrossProduct(rg.Vector3d.YAxis, rg.Vector3d.ZAxis)
#print rg.Vector3d.CrossProduct(rg.Vector3d.ZAxis, rg.Vector3d.XAxis)

    robot_plane = rg.Plane(origin, xaxis, xaxis)
# ---------- end calc_robot_plane ----------
panel_21 = Panel(rec)
panel_22 = Panel(calc_robot_plane.out)

# ----
# Direct UR control + Lift control
rec_2 = DataRecorder(pose_2.out, DataLimit=-10, RecordData=True)
pln_19 = Plane(calc_robot_plane.robot_plane)

panel_23 = Panel(rec_2)

# ----
# Calculate Basis - Point fitting method via RPC
rcf_wcs_aa_0_corr_2 = Plane(Plane(origin=(-0.978529, -0.599953, 1.040675), x=(0.2168499922, 0.9761839651, -0.006398999771), y=(-0.9761857946, 0.216882132, 0.004840998058)))
pt_2 = Point([<point referenced from the Rhino model> x3])

pln_20 = Plane(rcf_wcs_aa_0_corr_2)

calc_rcf = PythonScript(poses=rec, pts_cad=pt_2, RCF_plane_init_guess=pln_20, calc=Toggle(False))  # -> out, pts_mtip_init_guess, pts_mtip_fit, RCF_plane_fit, RCF_frame_fit; inputs poses: list, pts_cad: list of Point3d, RCF_plane_init_guess: Plane
# ---------- calc_rcf: Python ----------
import ghpythonlib.components as ghcomp
import Rhino.Geometry as rg
from scriptcontext import sticky as st
from compas.geometry import Frame
from compas.artists import Artist
import math as m
import sys
from compas.rpc import Proxy # for calling the numpy function in CPython

#icp_func = Proxy('ur_fabrication_control.optimisation.icp', python = 'C://Users//doerf//.conda//envs//rsrd_22//python.exe') #C:\Users\doerf\.conda\envs\rsrd_22
#print icp_func._python
#print poses
poses.pop(0)
#RCF_plane_init_guess = Artist(RCF_frame_init_guess).draw()

#poses = [[-0.58718800000000004, -0.18371299999999999, -1.0307900000000001, -2.7211500000000002, -0.58718700000000001, 0.359176], [-0.57886499999999996, -0.51754, -1.0328200000000001, -2.5670999999999999, -1.14205, 0.790659], [-0.28750700000000001, -0.60358299999999998, -1.03515, -2.5338500000000002, -1.7267600000000001, 0.27448299999999998]]
if len(poses):
    
    # get points from poses
    pts_mtip = [rg.Point3d(p[0], p[1], p[2]) for p in poses]
    
    T_W_R_init_guess = rg.Transform.PlaneToPlane(rg.Plane.WorldXY, RCF_plane_init_guess)
    pts_mtip_init_guess = [ghcomp.Transform(pt, T_W_R_init_guess) for pt in pts_mtip]
    
    # format Rhino transformation
    T_W_R_init_guess_flattened = [float(f) for f in T_W_R_init_guess.ToFloatArray(True)]
    T_W_R_init_guess_list = [T_W_R_init_guess_flattened[i:(i + 4)] for i in range(0, len(T_W_R_init_guess_flattened), 4)]  

    # format ptsA and ptsB
    dataB = [list(pt) for pt in pts_cad]
    dataA = [list(pt) for pt in pts_mtip]
    
    # call the function
    max_iterations = 100
    
    if calc:
        icp_func = Proxy('ur_fabrication_control.optimisation.icp', python = 'C://Users//afab_//.conda//envs//cdf//python.exe')
        #icp_func = Proxy('ur_fabrication_control.optimisation.icp', python = 'C://Users//doerf//.conda//envs//rsrd_22//python.exe') #C:\Users\doerf\.conda\envs\rsrd_22
        
        
        print icp_func._python

        transformation, distances = icp_func.icp(dataA, dataB, init_guess=T_W_R_init_guess_list, max_iterations=max_iterations, tolerance=0.000001)
        
        print "distances", distances
        
        # format result
        T = rg.Transform.Identity
        for i in range(4):
            for j in range(4):
                code = "T.M%i%i = %f" % (i, j, transformation[i][j])
                print code
                exec(code)
        #print T
        
        # now transform the points with the transformation calculated
        pts_mtip_fit = [ghcomp.Transform(pt, T) for pt in pts_mtip]
        RCF_plane_fit = ghcomp.Transform(rg.Plane.WorldXY, T)
        RCF_frame_fit = Frame(RCF_plane_fit.Origin, RCF_plane_fit.XAxis, RCF_plane_fit.YAxis)
        
        
        #f = Frame(base_plane_fit)
        #print f.get_pose_quaternion()
        
        # correct the zvalue
        #base_plane_fit = ghcomp.Transform(base_plane_fit, rg.Transform.Translation(0,0,-3))
# ---------- end calc_rcf ----------
pt_3 = Point(calc_rcf.pts_mtip_init_guess)
pt_4 = Point(calc_rcf.pts_mtip_fit)

pln_21 = Plane(calc_rcf.RCF_plane_fit)
